# Grasshopper definition a2.ghx (Grasshopper 1.0.8)
# plug-ins: Kangaroo2 Components

construct_point = ConstructPoint(XCoordinate=0, YCoordinate=0, ZCoordinate=0)
fence_height = Slider(1.2, range=-0.5..1.2)
post_no = Slider(4, range=4..8)
post_distance = Slider(0.17, range=0..0.2)
post_shape = Slider(4, range=4..6)
post_r = Slider(0.02, range=0.01..0.02)
curve = Slider(4.5, range=1..5)
rotate = Slider(8, range=0..8)
extrude = Slider(0.5, range=0..1)
construct_point_2 = ConstructPoint(XCoordinate=0, YCoordinate=0, ZCoordinate=0)
multiplication = Multiplication(A=extrude, B=-1000)
multiplication_2 = Multiplication(A=fence_height, B=1000)
multiplication_3 = Multiplication(A=post_r, B=1000)
multiplication_4 = Multiplication(A=post_distance, B=1000)
unit_z = UnitZ(Factor=multiplication_2)
move = Move(Geometry=construct_point_2, Motion=unit_z)  # -> Geometry, Transform
line = Line(StartPoint=construct_point_2, EndPoint=move.Geometry)
radial = Radial(Plane=construct_point_2, Size=multiplication_4, ExtentR=1, ExtentP=post_no)  # -> Cells, Points
area = Area(Geometry=radial.Cells)
line_2 = Line(StartPoint=construct_point_2, EndPoint=area)
polyline = PolyLine(Vertices=area, Closed=True)
explode = Explode(Curve=polyline, Recursive=True)  # -> Segments, Vertices
data = Data(construct_point_2)
data_2 = Data(area)
line_line = LineLine(LineA=explode.Segments, LineB=line_2)
construct_domain = ConstructDomain(DomainStart=0, DomainEnd=1)
move_2 = Move(Geometry=data_2, Motion=unit_z)  # -> Geometry, Transform
radial_2 = Radial(Plane=line_line, Size=multiplication_3, ExtentR=1, ExtentP=post_shape)  # -> Cells, Points
range = Range(Domain=construct_domain, Steps=Slider(50, range=20..100))
region_union = RegionUnion(Curves=radial_2.Cells)
line_3 = Line(StartPoint=data_2, EndPoint=move_2.Geometry)  # -> graft(Line)
data_3 = Data(line)
move_3 = Move(Geometry=region_union, Motion=unit_z)  # -> Geometry, Transform
evaluate_curve = EvaluateCurve(Curve=reparameterize(line_3), Parameter=range)  # -> Point, Tangent, Angle
evaluate_curve_2 = EvaluateCurve(Curve=reparameterize(data_3), Parameter=range)  # -> Point, Tangent, Angle
curve_middle = CurveMiddle(Curve=data_3)
distance = Distance(PointA=evaluate_curve.Point, PointB=data)
multiplication_5 = Multiplication(A=rotate, B=45)
distance_2 = Distance(PointA=evaluate_curve.Point, PointB=curve_middle)
construct_domain_2 = ConstructDomain(DomainStart=0, DomainEnd=multiplication_5)
bounds = Bounds(Numbers=flatten(distance))
bounds_2 = Bounds(Numbers=distance_2)
construct_domain_3 = ConstructDomain(DomainStart=curve, DomainEnd=1)
remap_numbers = RemapNumbers(Value=distance, Source=bounds, Target=construct_domain_2)  # -> Mapped, Clipped
remap_numbers_2 = RemapNumbers(Value=distance_2, Source=bounds_2, Target=construct_domain_3)  # -> Mapped, Clipped
graph_mapper = GraphMapper(remap_numbers_2.Mapped, x0=1, x1=5, y0=1, y1=5, Cx=0.688337326, Cy=0.2679545283, container_name="Conic")
scale = Scale(Geometry=evaluate_curve.Point, Center=evaluate_curve_2.Point, Factor=graph_mapper)  # -> Geometry, Transform
rotate_2 = Rotate(Geometry=scale.Geometry, Angle=degrees(remap_numbers.Mapped), Plane=PlaneXY(0, 0, 0))  # -> Geometry, Transform
panel = Panel(remap_numbers_2.Mapped)
polyline_2 = PolyLine(Vertices=rotate_2.Geometry, Closed=False)
sweep1 = Sweep1(Rail=polyline_2, Sections=region_union, Miter=1)
cap_holes_ex = CapHolesEx(Brep=sweep1)  # -> Brep, Caps, Solid
panel_2 = Panel(graph_mapper)
data_4 = Data(region_union)
unit_z_2 = UnitZ(Factor=multiplication)
extrude_2 = Extrude(Base=data_4, Direction=unit_z_2)
cap_holes_ex_2 = CapHolesEx(Brep=extrude_2)  # -> Brep, Caps, Solid
mirror = Mirror(Geometry=cap_holes_ex_2.Brep, Plane=curve_middle)  # -> Geometry, Transform
data_5 = Data(cap_holes_ex.Brep)
group = Group(Objects=[mirror.Geometry, cap_holes_ex_2.Brep, data_5])  # -> graft(Group)
brep = Brep([<brep referenced from the Rhino model> x89])
box_mapping = BoxMapping(Geometry=group, Source=group, Target=brep)  # -> Geometry, Transform
number_slider = Slider(2, range=0..10)
unit_y = UnitY(Factor=1)
multiplication_6 = Multiplication(A=Slider(0.87, range=0..1), B=1000)
multiplication_7 = Multiplication(A=Slider(0.3, range=0..1), B=1000)
series = Series(Start=0, Step=Slider(0.07, range=0..0.1), Count=20)
multiplication_8 = Multiplication(A=series, B=1000)
construct_domain_4 = ConstructDomain(DomainStart=Slider(0, range=0..100), DomainEnd=Slider(2, range=0..10))

number_slider_2 = Slider(3, range=2..20)
number_slider_3 = Slider(118, range=0..200)
number_slider_4 = Slider(25, range=0..1000)
number_slider_5 = Slider(7, range=5..10)
subtraction = Subtraction(A=15, B=number_slider_5)

multiplication_9 = Multiplication(A=Slider(24, range=10..30), B=1000)
multiplication_10 = Multiplication(A=multiplication_9, B=Slider(0.4, range=0.4..0.6))
multiplication_11 = Multiplication(A=Slider(25, range=10..30), B=1000)
multiplication_12 = Multiplication(A=multiplication_11, B=Slider(0.41, range=0.4..0.6))
rectangle = Rectangle(Plane=construct_point, XSize=multiplication_9, YSize=multiplication_11, Radius=0)  # -> Rectangle, Length
rectangle_2 = Rectangle(Plane=construct_point, XSize=multiplication_10, YSize=multiplication_12, Radius=0)  # -> Rectangle, Length
region_difference = RegionDifference(CurvesA=rectangle.Rectangle, CurvesB=rectangle_2.Rectangle)
multiplication_13 = Multiplication(A=Slider(0.16, range=0.1..0.3), B=1000)
unit_z_3 = UnitZ(Factor=multiplication_13)
move_4 = Move(Geometry=rectangle_2.Rectangle, Motion=unit_z_3)  # -> Geometry, Transform
extrude_3 = Extrude(Base=rectangle_2.Rectangle, Direction=unit_z_3)
extrude_4 = Extrude(Base=region_difference, Direction=unit_z_3)
move_5 = Move(Geometry=region_difference, Motion=unit_z_3)  # -> Geometry, Transform
explode_2 = Explode(Curve=move_5.Geometry, Recursive=True)  # -> Segments, Vertices
list_item = ListItem(List=explode_2.Segments, Index=0, Wrap=True)
length = Length(Curve=list_item)
multiplication_14 = Multiplication(A=Slider(0.65, range=0.2..1), B=-1000)
multiplication_15 = Multiplication(A=Slider(2.99, range=0.01..10), B=1000)
multiplication_16 = Multiplication(A=Slider(2.5, range=2.5..4.5), B=1000)
unit_y_2 = UnitY(Factor=multiplication_15)
unit_z_4 = UnitZ(Factor=multiplication_16)
multiplication_17 = Multiplication(A=unit_z_4, B=0.4)
multiplication_18 = Multiplication(A=Slider(1.47, range=1..3), B=1000)
multiplication_19 = Multiplication(A=multiplication_18, B=-0.5)
unit_x = UnitX(Factor=multiplication_18)
multiplication_20 = Multiplication(A=Slider(2, range=2..3), B=1000)
unit_z_5 = UnitZ(Factor=multiplication_20)
unit_y_3 = UnitY(Factor=multiplication_14)
multiplication_21 = Multiplication(A=Slider(1.5, range=0.5..8), B=1000)
unit_x_2 = UnitX(Factor=multiplication_19)
reverse = Reverse(Vector=unit_y_3)
addition = Addition(A=number_slider_2, B=1)
series_2 = Series(Start=number_slider_2, Step=addition, Count=6)
series_3 = Series(Start=0, Step=addition, Count=6)
reverse_2 = Reverse(Vector=unit_z_3)
multiplication_22 = Multiplication(A=multiplication_13, B=Slider(0.38, range=0..1))

cap_holes = CapHoles(Brep=extrude_3)

cap_holes_2 = CapHoles(Brep=extrude_4)

data_6 = Data(cap_holes_2)
deconstruct_brep = DeconstructBrep(Brep=data_6)  # -> Faces, Edges, Vertices
list_item_2 = ListItem(List=deconstruct_brep.Faces, Index=7, Wrap=True)

multiplication_23 = Multiplication(A=length, B=-0.2)

offset_curve = OffsetCurve(Curve=move_4.Geometry, Distance=multiplication_23, Corners=1)
area_2 = Area(Geometry=offset_curve)  # -> Area, Centroid
end_points = EndPoints(Curve=offset_curve)  # -> Start, End
offset_curve_2 = OffsetCurve(Curve=move_5.Geometry, Distance=multiplication_23, Corners=1)
deconstruct = Deconstruct(Point=area_2.Centroid)  # -> XComponent, YComponent, ZComponent
multiplication_24 = Multiplication(A=multiplication_23, B=1.5)
explode_3 = Explode(Curve=offset_curve_2, Recursive=True)  # -> Segments, Vertices
list_item_3 = ListItem(List=explode_3.Segments, Index=2, Wrap=True)
extrude_5 = Extrude(Base=list_item_3, Direction=unit_y_2)
region_difference_2 = RegionDifference(CurvesA=offset_curve_2, CurvesB=extrude_5)
offset_curve_3 = OffsetCurve(Curve=region_difference_2, Distance=multiplication_14, Corners=1)
boundary_surfaces = BoundarySurfaces(Edges=region_difference_2)
surface_split = SurfaceSplit(Surface=boundary_surfaces, Curves=offset_curve_3)
list_item_4 = ListItem(List=surface_split, Index=0, Wrap=True)
extrude_6 = Extrude(Base=list_item_4, Direction=unit_z_4)
explode_4 = Explode(Curve=region_difference_2, Recursive=True)  # -> Segments, Vertices
list_item_5 = ListItem(List=explode_4.Segments, Index=2, Wrap=True)
curve_middle_2 = CurveMiddle(Curve=list_item_5)
move_6 = Move(Geometry=curve_middle_2, Motion=unit_x)  # -> Geometry, Transform
line_4 = Line(StartPoint=curve_middle_2, EndPoint=move_6.Geometry)
extrude_7 = Extrude(Base=line_4, Direction=unit_z_5)
extrude_8 = Extrude(Base=extrude_7, Direction=reverse)
move_7 = Move(Geometry=extrude_8, Motion=unit_x_2)  # -> Geometry, Transform
solid_difference = SolidDifference(BrepsA=extrude_6, BrepsB=move_7.Geometry)
data_7 = Data(offset_curve)
boundary_surfaces_2 = BoundarySurfaces(Edges=data_7)
multiplication_25 = Multiplication(A=multiplication_23, B=0.2)
multiplication_26 = Multiplication(A=multiplication_23, B=Slider(0.65, range=0.5..1))

move_8 = Move(Geometry=region_difference_2, Motion=unit_z_4)  # -> Geometry, Transform
list_item_6 = ListItem(List=deconstruct_brep.Faces, Index=6, Wrap=True)

offset_curve_4 = OffsetCurve(Curve=move_8.Geometry, Distance=multiplication_24, Corners=1)
data_8 = Data(move_8.Geometry)
brep_edges = BrepEdges(Brep=data_8)  # -> reverse(Naked), Interior, NonManifold
divide_curve = DivideCurve(Curve=brep_edges.Naked, Count=number_slider_2, Kinks=False)  # -> flatten(Points), Tangents, Parameters
deconstruct_brep_2 = DeconstructBrep(Brep=list_item_6)  # -> Faces, Edges, Vertices
list_item_7 = ListItem(List=deconstruct_brep_2.Vertices, Index=0, Wrap=True)  # -> Item, Item1, Item2, Item3, Item4, Item5
vector_2pt = Vector2Pt(PointA=list_item_7.Item1, PointB=list_item_7.Item4, Unitize=False)  # -> Vector, Length
vector_2pt_2 = Vector2Pt(PointA=list_item_7.Item3, PointB=list_item_7.Item5, Unitize=False)  # -> Vector, Length
multiplication_27 = Multiplication(A=vector_2pt_2.Vector, B=Slider(0.07, range=0..0.1))
reverse_3 = Reverse(Vector=multiplication_27)
multiplication_28 = Multiplication(A=multiplication_27, B=2)
multiplication_29 = Multiplication(A=multiplication_28, B=0.05)
reverse_4 = Reverse(Vector=multiplication_29)
multiplication_30 = Multiplication(A=multiplication_29, B=0.5)
contour = Contour(Shape=list_item_6, Point=Point(0, 0, 0), Direction=unit_y, Distance=multiplication_6)
contour_2 = Contour(Shape=list_item_6, Point=Point(0, 0, 0), Direction=vector_2pt.Vector, Distance=multiplication_6)
contour_3 = Contour(Shape=list_item_6, Point=Point(0, 0, 0), Direction=vector_2pt_2.Vector, Distance=multiplication_6)

move_9 = Move(Geometry=offset_curve_4, Motion=multiplication_17)  # -> Geometry, Transform

extrude_9 = Extrude(Base=move_9.Geometry, Direction=unit_z_3)
move_10 = Move(Geometry=move_9.Geometry, Motion=unit_z_3)  # -> Geometry, Transform
data_9 = Data(move_10.Geometry)
explode_5 = Explode(Curve=data_9, Recursive=True)  # -> Segments, Vertices
list_item_8 = ListItem(List=explode_5.Vertices, Index=5, Wrap=True)
list_item_9 = ListItem(List=explode_5.Vertices, Index=3, Wrap=True)
rectangle_2pt = Rectangle2Pt(Plane=list_item_9, PointA=list_item_9, PointB=list_item_8, Radius=0)  # -> Rectangle, Length
cap_holes_3 = CapHoles(Brep=extrude_9)
area_3 = Area(Geometry=move_10.Geometry)  # -> Area, Centroid
data_10 = Data(area_3.Centroid)
deconstruct_2 = Deconstruct(Point=data_10)  # -> XComponent, YComponent, ZComponent

subtraction_2 = Subtraction(A=deconstruct_2.ZComponent, B=deconstruct.ZComponent)
unit_z_6 = UnitZ(Factor=subtraction_2)

move_11 = Move(Geometry=end_points.Start, Motion=unit_z_6)  # -> Geometry, Transform
move_12 = Move(Geometry=area_2.Centroid, Motion=unit_z_6)  # -> Geometry, Transform
extrude_10 = Extrude(Base=offset_curve, Direction=unit_z_6)
vector_2pt_3 = Vector2Pt(PointA=end_points.Start, PointB=move_12.Geometry, Unitize=False)  # -> Vector, Length
rectangle_2pt_2 = Rectangle2Pt(Plane=move_11.Geometry, PointA=move_11.Geometry, PointB=data_10, Radius=0)  # -> Rectangle, Length
panel_3 = Panel(vector_2pt_3.Vector)
extrude_11 = Extrude(Base=rectangle_2pt_2.Rectangle, Direction=unit_z_6)
move_13 = Move(Geometry=rectangle_2pt.Rectangle, Motion=unit_z_6)  # -> Geometry, Transform
explode_6 = Explode(Curve=move_13.Geometry, Recursive=True)  # -> Segments, Vertices
extrude_12 = Extrude(Base=move_13.Geometry, Direction=unit_z_6)
list_item_10 = ListItem(List=explode_6.Vertices, Index=2, Wrap=True)
boundary_surfaces_3 = BoundarySurfaces(Edges=explode_6.Segments)
boundary_surfaces_4 = BoundarySurfaces(Edges=rectangle_2pt_2.Rectangle)
loft = Loft(
    Curves=flatten([move_10.Geometry, move_8.Geometry, move_9.Geometry]),
    Options={Adjust=False, Closed=False, LoftEnds=0, LoftSimp=0, LoftType=0, Rebuild=10, Refit=0.01})
move_14 = Move(Geometry=list_item_10, Motion=unit_z_6)  # -> Geometry, Transform
extrude_13 = Extrude(Base=loft, Direction=unit_z_3)
data_11 = Data(move_9.Geometry)
brep_edges_2 = BrepEdges(Brep=data_11)  # -> Naked, Interior, NonManifold
data_12 = Data(move_13.Geometry)
data_13 = Data(rectangle_2pt_2.Rectangle)
boundary_surfaces_5 = BoundarySurfaces(Edges=data_12)
cull_index = CullIndex(List=brep_edges_2.Naked, Indices=0, Wrap=True)
list_item_11 = ListItem(List=brep_edges_2.Naked, Index=0, Wrap=True)
boundary_surfaces_6 = BoundarySurfaces(Edges=data_13)
divide_curve_2 = DivideCurve(Curve=list_item_11, Count=number_slider_2, Kinks=False)  # -> flatten(Points), Tangents, Parameters
divide_curve_3 = DivideCurve(Curve=cull_index, Count=number_slider_2, Kinks=False)  # -> flatten(Points), Tangents, Parameters
merge = Merge(Data1=divide_curve_3.Points, Data2=divide_curve_2.Points)
line_5 = Line(StartPoint=divide_curve.Points, EndPoint=merge)
project = Project(Curve=line_5, Brep=loft, Direction=Vector(0, 0, 1))  # -> flatten(Curve)

cap_holes_4 = CapHoles(Brep=extrude_10)
cap_holes_5 = CapHoles(Brep=extrude_11)
cap_holes_6 = CapHoles(Brep=extrude_12)
solid_union = SolidUnion(Breps=flatten([cap_holes_6, cap_holes_4, cap_holes_5]))
cull_index_2 = CullIndex(List=project, Indices=[series_2, series_3], Wrap=True)

end_points_2 = EndPoints(Curve=cull_index_2)  # -> Start, End
divide_curve_4 = DivideCurve(Curve=cull_index_2, Count=Slider(8, range=0..10), Kinks=False)  # -> Points, Tangents, Parameters
line_6 = Line(StartPoint=end_points_2.Start, EndPoint=end_points_2.End)
data_14 = Data(end_points_2.Start)
flip_matrix = FlipMatrix(Data=divide_curve_4.Points)
boundary_surfaces_7 = BoundarySurfaces(Edges=[line_6, cull_index_2])
evaluate_surface = EvaluateSurface(Surface=boundary_surfaces_7, Point=data_14)  # -> Point, Normal, UDirection, VDirection, Frame
multiplication_31 = Multiplication(A=evaluate_surface.Normal, B=Slider(0.2, range=0.1..0.2))
multiplication_32 = Multiplication(A=multiplication_31, B=1000)

contour_4 = Contour(Shape=solid_union, Point=end_points.Start, Direction=vector_2pt_3.Vector, Distance=multiplication_21)
extrude_14 = Extrude(Base=boundary_surfaces_7, Direction=multiplication_32)

area_4 = Area(Geometry=contour_4)  # -> Area, flatten(Centroid)
merge_2 = Merge(Data1=flatten(end_points.Start), Data2=area_4.Centroid, Data3=flatten(move_14.Geometry))

polyline_3 = PolyLine(Vertices=merge_2, Closed=False)
project_2 = Project(Curve=polyline_3, Brep=boundary_surfaces_5, Direction=Vector(0, 0, 1))
project_3 = Project(Curve=polyline_3, Brep=boundary_surfaces_6, Direction=Vector(0, 0, 1))
project_4 = Project(Curve=polyline_3, Brep=boundary_surfaces_2, Direction=Vector(0, 0, 1))
interpolate = Interpolate(Vertices=flip_matrix, Degree=3, Periodic=True, KnotStyle=1)  # -> flatten(Curve), Length, Domain
loft_2 = Loft(
    Curves=interpolate.Curve,
    Options={Adjust=False, Closed=False, LoftEnds=0, LoftSimp=0, LoftType=0, Rebuild=10, Refit=0.01})
project_5 = Project(Curve=[contour, contour_2, contour_3], Brep=loft_2, Direction=Vector(0, 0, 1))  # -> flatten(Curve)

surface_curve = SurfaceCurve(Surface=boundary_surfaces_3, Curve=polyline_3)  # -> Curves, Points, UVPoints, Normals, Parameters, Tangents
surface_curve_2 = SurfaceCurve(Surface=boundary_surfaces_4, Curve=polyline_3)  # -> Curves, Points, UVPoints, Normals, Parameters, Tangents
trim_with_brep = TrimWithBrep(Curve=polyline_3, Brep=cap_holes_5)  # -> Inside, Outside
surface_split_2 = SurfaceSplit(Surface=boundary_surfaces_5, Curves=project_2)
surface_split_3 = SurfaceSplit(Surface=boundary_surfaces_6, Curves=project_3)
surface_split_4 = SurfaceSplit(Surface=boundary_surfaces_2, Curves=project_4)
list_item_12 = ListItem(List=surface_split_2, Index=1, Wrap=True)
list_item_13 = ListItem(List=surface_split_3, Index=0, Wrap=True)
list_item_14 = ListItem(List=surface_split_4, Index=1, Wrap=True)
deconstruct_brep_3 = DeconstructBrep(Brep=loft_2)  # -> Faces, Edges, Vertices
list_item_15 = ListItem(List=deconstruct_brep_3.Edges, Index=2, Wrap=True)
project_6 = Project(Curve=list_item_15, Brep=list_item_2, Direction=Vector(0, 0, 1))
area_5 = Area(Geometry=list_item_15)  # -> Area, Centroid
list_item_16 = ListItem(List=deconstruct_brep_3.Edges, Index=1, Wrap=True)
offset_curve_5 = OffsetCurve(Curve=project_6, Distance=multiplication_23, Corners=1)
offset_curve_6 = OffsetCurve(Curve=list_item_16, Distance=multiplication_26, Corners=1)
offset_curve_7 = OffsetCurve(Curve=offset_curve_5, Distance=expr("-X", multiplication_25), Corners=1)
project_7 = Project(Curve=offset_curve_6, Brep=list_item_6, Direction=Vector(0, 0, 1))
divide_curve_5 = DivideCurve(Curve=project_7, Count=number_slider_5, Kinks=False)  # -> Points, Tangents, Parameters
end_points_3 = EndPoints(Curve=offset_curve_7)  # -> Start, End
deconstruct_3 = Deconstruct(Point=area_5.Centroid)  # -> XComponent, YComponent, ZComponent
list_item_17 = ListItem(List=divide_curve_5.Points, Index=0, Wrap=True)
deconstruct_4 = Deconstruct(Point=end_points_3.Start)  # -> XComponent, YComponent, ZComponent
subtraction_3 = Subtraction(A=deconstruct_3.ZComponent, B=deconstruct_4.ZComponent)
unit_z_7 = UnitZ(Factor=subtraction_3)
move_15 = Move(Geometry=offset_curve_7, Motion=unit_z_7)  # -> Geometry, Transform
boundary_surfaces_8 = BoundarySurfaces(Edges=list_item_15)
circle = Circle(Plane=list_item_17, Radius=multiplication_7)  # -> graft(Circle)
boundary_surfaces_9 = BoundarySurfaces(Edges=move_15.Geometry)
offset_curve_8 = OffsetCurve(Curve=circle, Distance=multiplication_8, Corners=1)  # -> flatten(Curve)
bounds_3 = Bounds(Numbers=offset_curve_8)
remap_numbers_3 = RemapNumbers(Value=offset_curve_8, Source=bounds_3, Target=construct_domain_4)  # -> Mapped, Clipped
graph_mapper_2 = GraphMapper(
    remap_numbers_3.Mapped,
    x0=0,
    x1=15,
    y0=0,
    y1=1,
    container_name="Bezier",
    cpx=[0, 0, 0.2814481556, 1],
    cpy=[0, 0.1633273959, 0.5260089636, 0.5877411366])
multiplication_33 = Multiplication(A=graph_mapper_2, B=Slider(26, range=0..100))
multiplication_34 = Multiplication(A=multiplication_33, B=1000)
unit_z_8 = UnitZ(Factor=multiplication_34)
move_16 = Move(Geometry=offset_curve_8, Motion=unit_z_8)  # -> Geometry, Transform
loft_3 = Loft(
    Curves=move_16.Geometry,
    Options={Adjust=False, Closed=False, LoftEnds=0, LoftSimp=0, LoftType=0, Rebuild=10, Refit=0.01})
curve_array = CurveArray(Geometry=loft_3, Curve=project_7, Count=number_slider_5)  # -> Geometry, Transform
split_brep = SplitBrep(Brep=curve_array.Geometry, Cutter=loft_2)
list_item_18 = ListItem(List=split_brep, Index=0, Wrap=True)  # -> Item, Item1
brep_edges_3 = BrepEdges(Brep=list_item_18.Item)  # -> Naked, Interior, NonManifold
list_item_19 = ListItem(List=brep_edges_3.Naked, Index=0, Wrap=True)  # -> Item, Item1
divide_curve_6 = DivideCurve(Curve=list_item_19.Item1, Count=subtraction, Kinks=False)  # -> Points, Tangents, Parameters
surface_closest_point = SurfaceClosestPoint(Point=divide_curve_6.Points, Surface=list_item_18.Item1)  # -> Point, UVPoint, Distance
iso_curve = IsoCurve(Surface=list_item_18.Item1, UVPoint=surface_closest_point.UVPoint)  # -> UIsocurve, VIsocurve

list_item_20 = ListItem(List=trim_with_brep.Outside, Index=0, Wrap=True)
list_item_21 = ListItem(List=trim_with_brep.Outside, Index=1, Wrap=True)
data_15 = Data(trim_with_brep.Inside)
list_item_22 = ListItem(List=surface_split_4, Index=0, Wrap=True)
list_item_23 = ListItem(List=surface_split_2, Index=0, Wrap=True)
list_item_24 = ListItem(List=surface_split_3, Index=1, Wrap=True)
loft_4 = Loft(
    Curves=flatten([move_15.Geometry, offset_curve_5]),
    Options={Adjust=False, Closed=False, LoftEnds=0, LoftSimp=0, LoftType=0, Rebuild=10, Refit=0.01})
solid_difference_2 = SolidDifference(BrepsA=boundary_surfaces_9, BrepsB=boundary_surfaces_8)
data_16 = Data(iso_curve.UIsocurve)

project_8 = Project(Curve=data_15, Brep=list_item_24, Direction=Vector(0, 0, 1))
project_9 = Project(Curve=list_item_21, Brep=list_item_23, Direction=Vector(0, 0, 1))
project_10 = Project(Curve=project_9, Brep=list_item_24, Direction=Vector(0, 0, 1))
project_11 = Project(Curve=project_8, Brep=list_item_22, Direction=Vector(0, 0, 1))
project_12 = Project(Curve=list_item_20, Brep=list_item_22, Direction=Vector(0, 0, 1))
move_17 = Move(Geometry=project_10, Motion=unit_z_6)  # -> Geometry, Transform
move_18 = Move(Geometry=project_11, Motion=unit_z_6)  # -> Geometry, Transform
deconstruct_brep_4 = DeconstructBrep(Brep=loft_4)  # -> Faces, Edges, Vertices
offset_surface = OffsetSurface(Surface=deconstruct_brep_4.Faces, Distance=multiplication_29, Retrim=True)
area_6 = Area(Geometry=deconstruct_brep_4.Faces)  # -> Area, Centroid
area_7 = Area(Geometry=offset_surface)  # -> Area, Centroid
vector_2pt_4 = Vector2Pt(PointA=area_6.Centroid, PointB=area_7.Centroid, Unitize=False)  # -> Vector, Length

extrude_15 = Extrude(Base=[project_12, project_11], Direction=multiplication_27)
extrude_16 = Extrude(Base=[project_8, project_10], Direction=reverse_3)
extrude_17 = Extrude(Base=project_9, Direction=multiplication_27)
extrude_18 = Extrude(Base=deconstruct_brep_4.Faces, Direction=vector_2pt_4.Vector)

region_union_2 = RegionUnion(Curves=extrude_16)
region_union_3 = RegionUnion(Curves=extrude_15)
region_union_4 = RegionUnion(Curves=extrude_17)
extrude_19 = Extrude(Base=[region_union_4, region_union_2, region_union_3], Direction=reverse_2)
populate_geometry = PopulateGeometry(Geometry=extrude_17, Count=number_slider_3, Seed=1)
populate_geometry_2 = PopulateGeometry(Geometry=extrude_16, Count=number_slider_3, Seed=1)
populate_geometry_3 = PopulateGeometry(Geometry=flatten(extrude_15), Count=number_slider_3, Seed=1)
proximity_3d = Proximity3D(Points=populate_geometry, Group=5)  # -> Links, Topology
proximity_3d_2 = Proximity3D(Points=populate_geometry_2, Group=5)  # -> Links, Topology
proximity_3d_3 = Proximity3D(Points=populate_geometry_3, Group=5)  # -> Links, Topology
end_points_4 = EndPoints(Curve=data_16)  # -> Start, End
radial_3 = Radial(Plane=end_points_4.Start, Size=multiplication_22, ExtentR=1, ExtentP=4)  # -> Cells, Points
region_union_5 = RegionUnion(Curves=radial_3.Cells)

loft_5 = Loft(
    Curves=flatten([list_item_21, project_9]),
    Options={Adjust=False, Closed=False, LoftEnds=0, LoftSimp=0, LoftType=0, Rebuild=10, Refit=0.01})
loft_6 = Loft(
    Curves=flatten([data_15, project_8]),
    Options={Adjust=False, Closed=False, LoftEnds=0, LoftSimp=0, LoftType=0, Rebuild=10, Refit=0.01})
loft_7 = Loft(
    Curves=flatten([project_12, list_item_20]),
    Options={Adjust=False, Closed=False, LoftEnds=0, LoftSimp=0, LoftType=0, Rebuild=10, Refit=0.01})
loft_8 = Loft(
    Curves=[move_17.Geometry, project_10],
    Options={Adjust=False, Closed=False, LoftEnds=0, LoftSimp=0, LoftType=0, Rebuild=10, Refit=0.01})
loft_9 = Loft(
    Curves=[move_18.Geometry, project_11],
    Options={Adjust=False, Closed=False, LoftEnds=0, LoftSimp=0, LoftType=0, Rebuild=10, Refit=0.01})
cap_holes_7 = CapHoles(Brep=extrude_19)
offset_surface_2 = OffsetSurface(Surface=loft_2, Distance=expr("-X", multiplication_13), Retrim=True)
multipipe = MultiPipe(
    Curves=proximity_3d_3.Links,
    NodeSize=number_slider_4,
    EndOffset=number_slider,
    StrutSize=1,
    Segment=0,
    KinkAngle=0.6,
    CubeFit=0,
    Caps=2)
multipipe_2 = MultiPipe(
    Curves=proximity_3d_2.Links,
    NodeSize=number_slider_4,
    EndOffset=number_slider,
    StrutSize=1,
    Segment=0,
    KinkAngle=0.6,
    CubeFit=0,
    Caps=2)
multipipe_3 = MultiPipe(
    Curves=proximity_3d.Links,
    NodeSize=number_slider_4,
    EndOffset=number_slider,
    StrutSize=1,
    Segment=0,
    KinkAngle=0.6,
    CubeFit=0,
    Caps=2)
multipipe_4 = MultiPipe(Curves=project_5, NodeSize=multiplication_22, EndOffset=1, StrutSize=1, Segment=0, KinkAngle=0.6, CubeFit=0, Caps=2)
extrude_20 = Extrude(Base=solid_difference_2, Direction=reverse_2)
extrude_along = ExtrudeAlong(Base=region_union_5, Curve=data_16)

brep_join = BrepJoin(Breps=[loft_5, loft_8, loft_6, loft_9, loft_7])  # -> Breps, Closed
extrude_21 = Extrude(Base=brep_join.Breps, Direction=multiplication_29)
extrude_22 = Extrude(Base=brep_join.Breps, Direction=reverse_4)
solid_union_2 = SolidUnion(Breps=graft([extrude_21, extrude_22]))
brep_wireframe = BrepWireframe(Brep=solid_union_2, Density=-1)

move_19 = Move(Geometry=extrude_22, Motion=multiplication_30)  # -> Geometry, Transform
pipe = Pipe(Curve=brep_wireframe, Radius=multiplication_22, Caps=1)
