# Grasshopper definition assignment 1 BAKED MODEL Kevin.ghx (Grasshopper 1.0.8)

handrail_height = Slider(1.8, range=1.2..1.8)
handrail_r = Slider(0.23, range=0..0.3)
spanning = Slider(8.8, range=1..10)
column_extend = Slider(1, range=1..1.6)
height = Slider(5, range=1..5)
step_account = Slider(11, range=10..15)
landing_excel = Slider(0.44, range=0..0.5)
stair_width = Slider(3, range=1..3)
thickness = Slider(0.08, range=0.01..0.08)
trim = Slider(0.19, range=0.15..0.3)
chord = Slider(0.09, range=0.05..0.1)
balloon_seed = Slider(3.57, range=0..10)
multiplication = Multiplication(A=spanning, B=1000)
multiplication_2 = Multiplication(A=height, B=1000)
subtraction = Subtraction(A=step_account, B=1)
multiplication_3 = Multiplication(A=landing_excel, B=1000)
multiplication_4 = Multiplication(A=stair_width, B=1000)
multiplication_5 = Multiplication(A=thickness, B=1000)
multiplication_6 = Multiplication(A=handrail_height, B=1000)
multiplication_7 = Multiplication(A=chord, B=1000)
multiplication_8 = Multiplication(A=column_extend, B=1000)
multiplication_9 = Multiplication(A=handrail_r, B=1000)
unit_z = UnitZ(Factor=multiplication_5)
multiplication_10 = Multiplication(A=subtraction, B=2)
unit_z_2 = UnitZ(Factor=multiplication_6)
construct_domain = ConstructDomain(DomainStart=0, DomainEnd=multiplication)
construct_domain_2 = ConstructDomain(DomainStart=0, DomainEnd=multiplication_2)
subtraction_2 = Subtraction(A=multiplication_10, B=1)
range = Range(Domain=construct_domain, Steps=step_account)
range_2 = Range(Domain=construct_domain_2, Steps=step_account)
range_3 = Range(Domain=construct_domain_2, Steps=subtraction_2)
construct_point = ConstructPoint(XCoordinate=range, YCoordinate=0, ZCoordinate=range_2)
cull_index = CullIndex(List=construct_point, Indices=["0", step_account], Wrap=True)
subtraction_3 = Subtraction(A=step_account, B=2)
list_item = ListItem(List=cull_index, Index=0, Wrap=True)
list_item_2 = ListItem(List=cull_index, Index=subtraction_3, Wrap=True)
deconstruct = Deconstruct(Point=list_item)  # -> XComponent, YComponent, ZComponent
deconstruct_2 = Deconstruct(Point=list_item_2)  # -> XComponent, YComponent, ZComponent
data = Data(construct_point)
subtraction_4 = Subtraction(A=deconstruct_2.XComponent, B=multiplication_3)
addition = Addition(A=deconstruct.XComponent, B=multiplication_3)
unit_x = UnitX(Factor=addition)
data_2 = Data(step_account)
construct_domain_3 = ConstructDomain(DomainStart=addition, DomainEnd=subtraction_4)
reverse = Reverse(Vector=unit_x)
subtraction_5 = Subtraction(A=data_2, B=2)
range_4 = Range(Domain=construct_domain_3, Steps=subtraction_5)
list_item_3 = ListItem(List=range_4, Index=1, Wrap=True)
list_item_4 = ListItem(List=range_4, Index=0, Wrap=True)
unit_y = UnitY(Factor=multiplication_4)
subtraction_6 = Subtraction(A=list_item_3, B=list_item_4)
unit_x_2 = UnitX(Factor=subtraction_6)
data_3 = Data(unit_z)
brep = Brep([<brep referenced from the Rhino model> x101])
brep_2 = Brep([<brep referenced from the Rhino model> x56])
group = Group(Objects=brep)
group_2 = Group(Objects=brep_2)
data_4 = Data(unit_z_2)
multiplication_11 = Multiplication(A=multiplication_7, B=2)
unit_z_3 = UnitZ(Factor=1)
geometry = Geometry([<extrusion referenced from the Rhino model> x3, <brep referenced from the Rhino model>, <extrusion referenced from the Rhino model> x7, <brep referenced from the Rhino model>, <extrusion referenced from the Rhino model> x3, <brep referenced from the Rhino model> x2, <extrusion referenced from the Rhino model> x8])
group_3 = Group(Objects=geometry)
geometry_2 = Geometry(<brep referenced from the Rhino model>)
multiplication_12 = Multiplication(A=multiplication_8, B=0.5)
construct_domain_4 = ConstructDomain(DomainStart=multiplication_8, DomainEnd=multiplication_12)
multiplication_13 = Multiplication(A=multiplication_7, B=0.5)
multiplication_14 = Multiplication(A=multiplication_13, B=0.5)
multiplication_15 = Multiplication(A=multiplication_14, B=20)
construct_domain_5 = ConstructDomain(DomainStart="200", DomainEnd="500")
brep_3 = Brep([<brep referenced from the Rhino model> x12])
group_4 = Group(Objects=brep_3)
brep_4 = Brep([<brep referenced from the Rhino model> x8])
brep_5 = Brep([<brep referenced from the Rhino model> x8])
group_5 = Group(Objects=brep_4)
group_6 = Group(Objects=brep_5)

# ---- group: step height
list_item_5 = ListItem(List=range_3, Index=1, Wrap=True)
step_height = Panel(list_item_5)
unit_z_4 = UnitZ(Factor=list_item_5)
data_5 = Data(unit_z_4)
data_6 = Data(list_item_5)

# ----
unit_y_2 = UnitY(Factor=data_6)
unit_y_3 = UnitY(Factor=data_6)
multiplication_16 = Multiplication(A=data_5, B=-1)
multiplication_17 = Multiplication(A=unit_y_2, B=-1)
multiplication_18 = Multiplication(A=data_5, B=-1)
multiplication_19 = Multiplication(A=list_item_5, B=-1)
unit_z_5 = UnitZ(Factor=multiplication_19)

# ---- group: point
list_item_6 = ListItem(List=data, Index=step_account, Wrap=True)
list_item_7 = ListItem(List=data, Index=0, Wrap=True)
move = Move(Geometry=list_item_7, Motion=unit_x)  # -> Geometry, Transform
move_2 = Move(Geometry=list_item_6, Motion=reverse)  # -> Geometry, Transform

# ----
deconstruct_3 = Deconstruct(Point=list_item_6)  # -> XComponent, YComponent, ZComponent
construct_domain_6 = ConstructDomain(DomainStart=list_item_5, DomainEnd=deconstruct_3.ZComponent)
range_5 = Range(Domain=construct_domain_6, Steps=subtraction_5)
weave = Weave(
    Pattern=[0, 1, 2, 3],
    Stream0=list_item_7,
    Stream1=move.Geometry,
    Stream2=move_2.Geometry,
    Stream3=list_item_6,
    NullGaps=False)
construct_point_2 = ConstructPoint(XCoordinate=range_4, YCoordinate=0, ZCoordinate=range_5)
line = Line(StartPoint=move.Geometry, EndPoint=move_2.Geometry)
line_2 = Line(StartPoint=move_2.Geometry, EndPoint=list_item_6)
line_3 = Line(StartPoint=list_item_7, EndPoint=move.Geometry)

# ---- group: point (continued)
cull_index_2 = CullIndex(List=construct_point_2, Indices=subtraction_5, Wrap=True)
move_3 = Move(Geometry=cull_index_2, Motion=unit_x_2)  # -> Geometry, Transform

# ----
merge = Merge(Data1=line_2, Data2=line_3)  # -> graft(Result)
move_4 = Move(Geometry=merge, Motion=unit_y)  # -> Geometry, Transform

# ---- group: mirror point
weave_2 = Weave(Pattern=[0, 1], Stream0=cull_index_2, Stream1=move_3.Geometry, NullGaps=False)  # -> flatten(Weave)
move_5 = Move(Geometry=weave_2, Motion=unit_y)  # -> Geometry, Transform

# ----
# Doubleclick Me!
panel = Panel(weave_2)
dispatch = Dispatch(List=weave_2, DispatchPattern=[True, False])  # -> graft(ListA), graft(ListB)
dispatch_2 = Dispatch(List=move_5.Geometry, DispatchPattern=[True, False])  # -> graft(ListA), graft(ListB)
relay = Relay([merge, move_4.Geometry])

# ---- group: weave
weave_3 = Weave(Pattern=[0, 1, 2], Stream0=dispatch.ListA, Stream1=dispatch_2.ListB, Stream2=dispatch.ListB, NullGaps=False)
weave_4 = Weave(Pattern=[0, 1, 2], Stream0=dispatch_2.ListA, Stream1=dispatch.ListA, Stream2=dispatch_2.ListB, NullGaps=False)
weave_5 = Weave(Pattern=[0, 1], Stream0=dispatch.ListA, Stream1=dispatch.ListB, NullGaps=False)
weave_6 = Weave(Pattern=[0, 1], Stream0=dispatch_2.ListA, Stream1=dispatch_2.ListB, NullGaps=False)
move_6 = Move(Geometry=weave_5, Motion=unit_z_4)  # -> Geometry, Transform

# ----
polyline = PolyLine(Vertices=[weave_3, weave_5], Closed=False)
dispatch_3 = Dispatch(List=weave_6, DispatchPattern=[True, False])  # -> ListA, ListB
move_7 = Move(Geometry=polyline, Motion=unit_z_4)  # -> Geometry, Transform
polyline_2 = PolyLine(Vertices=[weave_4, weave_6], Closed=False)
data_7 = Data(dispatch_2.ListB)
data_8 = Data(dispatch.ListA)
line_4 = Line(StartPoint=dispatch_3.ListA, EndPoint=dispatch_3.ListB)

# ---- group: step height (continued)
move_8 = Move(Geometry=data_7, Motion=unit_z_4)  # -> Geometry, Transform

# ----
dispatch_4 = Dispatch(List=move_6.Geometry, DispatchPattern=[True, False])  # -> ListA, ListB
scale = Scale(Geometry=polyline_2, Center=data_8, Factor=trim)  # -> Geometry, Transform
scale_2 = Scale(Geometry=move_7.Geometry, Center=move_8.Geometry, Factor=trim)  # -> Geometry, Transform
boundary_surfaces = BoundarySurfaces(Edges=polyline_2)
line_5 = Line(StartPoint=dispatch_4.ListA, EndPoint=dispatch_4.ListB)
boundary_surfaces_2 = BoundarySurfaces(Edges=move_7.Geometry)
surface_split = SurfaceSplit(Surface=boundary_surfaces, Curves=scale.Geometry)
end_points = EndPoints(Curve=scale.Geometry)  # -> Start, End
end_points_2 = EndPoints(Curve=scale_2.Geometry)  # -> Start, End
data_9 = Data(dispatch.ListA)
surface_split_2 = SurfaceSplit(Surface=boundary_surfaces_2, Curves=scale_2.Geometry)
incircle = InCircle(CornerA=end_points.Start, CornerB=end_points.End, CornerC=data_9)  # -> Circle, Plane, Radius
incircle_2 = InCircle(CornerA=end_points_2.Start, CornerB=end_points_2.End, CornerC=move_8.Geometry)  # -> Circle, Plane, Radius

loft = Loft(Curves=relay, Options={Adjust=False, Closed=False, LoftEnds=0, LoftSimp=0, LoftType=0, Rebuild=10, Refit=0.01})
list_item_8 = ListItem(List=surface_split_2, Index=1, Wrap=True)
list_item_9 = ListItem(List=surface_split, Index=1, Wrap=True)

# ---- group: handrail
area = Area(Geometry=incircle_2.Circle)  # -> Area, flatten(Centroid)
area_2 = Area(Geometry=incircle.Circle)  # -> Area, flatten(Centroid)
data_10 = Data(area.Centroid)
data_11 = Data(area_2.Centroid)

# ----
rotate_axis = RotateAxis(Geometry=list_item_9, Angle=1.570796327, Axis=line_4)  # -> Geometry, Transform
rotate_axis_2 = RotateAxis(Geometry=list_item_8, Angle=4.71238898, Axis=line_5)  # -> Geometry, Transform
data_12 = Data(loft)
data_13 = Data(list_item_9)
data_14 = Data(list_item_8)

# ---- group: CLADDING
extrude = Extrude(Base=data_14, Direction=data_3)
extrude_2 = Extrude(Base=data_13, Direction=data_3)
extrude_3 = Extrude(Base=data_12, Direction=data_3)

# ----
brep_edges = BrepEdges(Brep=list_item_9)  # -> Naked, Interior, NonManifold
brep_edges_2 = BrepEdges(Brep=rotate_axis_2.Geometry)  # -> Naked, Interior, NonManifold
brep_edges_3 = BrepEdges(Brep=list_item_8)  # -> Naked, Interior, NonManifold
brep_edges_4 = BrepEdges(Brep=rotate_axis.Geometry)  # -> Naked, Interior, NonManifold
move_9 = Move(Geometry=line, Motion=unit_z_2)  # -> Geometry, Transform
list_item_10 = ListItem(List=brep_edges_4.Naked, Index=0, Wrap=True)
list_item_11 = ListItem(List=brep_edges.Naked, Index=0, Wrap=True)
list_item_12 = ListItem(List=brep_edges_3.Naked, Index=2, Wrap=True)
list_item_13 = ListItem(List=brep_edges_2.Naked, Index=3, Wrap=True)
list_item_14 = ListItem(List=brep_edges_3.Naked, Index=3, Wrap=True)
list_item_15 = ListItem(List=brep_edges_3.Naked, Index=1, Wrap=True)
list_item_16 = ListItem(List=brep_edges.Naked, Index=2, Wrap=True)
list_item_17 = ListItem(List=brep_edges.Naked, Index=1, Wrap=True)
box_mapping = BoxMapping(Geometry=group, Source=group, Target=extrude_3)  # -> Geometry, Transform
list_item_18 = ListItem(List=area.Centroid, Index=0, Wrap=True)
list_item_19 = ListItem(List=area_2.Centroid, Index=0, Wrap=True)
box_mapping_2 = BoxMapping(Geometry=group_2, Source=group_2, Target=extrude)  # -> Geometry, Transform
curve_middle = CurveMiddle(Curve=move_9.Geometry)
end_points_3 = EndPoints(Curve=list_item_11)  # -> Start, End
end_points_4 = EndPoints(Curve=list_item_15)  # -> Start, End
end_points_5 = EndPoints(Curve=list_item_12)  # -> Start, End
end_points_6 = EndPoints(Curve=list_item_10)  # -> Start, End
end_points_7 = EndPoints(Curve=list_item_13)  # -> Start, End
end_points_8 = EndPoints(Curve=list_item_14)  # -> Start, End
end_points_9 = EndPoints(Curve=list_item_16)  # -> Start, End
end_points_10 = EndPoints(Curve=list_item_17)  # -> Start, End
deconstruct_4 = Deconstruct(Point=list_item_18)  # -> XComponent, YComponent, ZComponent
polyline_3 = PolyLine(Vertices=weave, Closed=False)
deconstruct_5 = Deconstruct(Point=list_item_19)  # -> XComponent, YComponent, ZComponent
deconstruct_6 = Deconstruct(Point=curve_middle)  # -> XComponent, YComponent, ZComponent
end_points_11 = EndPoints(Curve=move_9.Geometry)  # -> Start, End
move_10 = Move(Geometry=end_points_3.End, Motion=multiplication_16)  # -> Geometry, Transform
move_11 = Move(Geometry=end_points_6.End, Motion=multiplication_17)  # -> Geometry, Transform
vector_2pt = Vector2Pt(PointA=end_points_10.End, PointB=end_points_10.Start, Unitize=False)  # -> Vector, Length
vector_2pt_2 = Vector2Pt(PointA=end_points_9.End, PointB=end_points_9.Start, Unitize=False)  # -> Vector, Length
vector_2pt_3 = Vector2Pt(PointA=end_points_4.Start, PointB=end_points_4.End, Unitize=False)  # -> Vector, Length
vector_2pt_4 = Vector2Pt(PointA=end_points_5.Start, PointB=end_points_5.End, Unitize=False)  # -> Vector, Length
move_12 = Move(Geometry=end_points_8.Start, Motion=multiplication_18)  # -> Geometry, Transform
move_13 = Move(Geometry=end_points_7.Start, Motion=unit_y_3)  # -> Geometry, Transform
move_14 = Move(Geometry=curve_middle, Motion=data_4)  # -> Geometry, Transform
subtraction_7 = Subtraction(A=deconstruct_5.YComponent, B=deconstruct_6.YComponent)

# ---- group: handrail distance
subtraction_8 = Subtraction(A=deconstruct_4.YComponent, B=deconstruct_5.YComponent)
unit_y_4 = UnitY(Factor=subtraction_8)

# ----
move_15 = Move(Geometry=polyline_3, Motion=data_4)  # -> Geometry, Transform
arc_3pt = Arc3Pt(PointA=end_points_11.Start, PointB=move_14.Geometry, PointC=end_points_11.End)  # -> Arc, Plane, Radius
weave_7 = Weave(
    Pattern=[0, 1, 2, 3, 4, 5],
    Stream0=end_points_8.End,
    Stream1=end_points_8.Start,
    Stream2=move_12.Geometry,
    Stream3=move_13.Geometry,
    Stream4=end_points_7.Start,
    Stream5=end_points_8.End,
    NullGaps=False)
move_16 = Move(Geometry=end_points_5.Start, Motion=vector_2pt_4.Vector)  # -> Geometry, Transform
move_17 = Move(Geometry=end_points_8.End, Motion=vector_2pt_3.Vector)  # -> Geometry, Transform
move_18 = Move(Geometry=move_12.Geometry, Motion=vector_2pt_4.Vector)  # -> Geometry, Transform
move_19 = Move(Geometry=move_13.Geometry, Motion=vector_2pt_4.Vector)  # -> Geometry, Transform
move_20 = Move(Geometry=end_points_7.Start, Motion=vector_2pt_4.Vector)  # -> Geometry, Transform
weave_8 = Weave(
    Pattern=[0, 1, 2, 3, 4, 5],
    Stream0=end_points_3.Start,
    Stream1=end_points_3.End,
    Stream2=move_10.Geometry,
    Stream3=move_11.Geometry,
    Stream4=end_points_6.End,
    Stream5=end_points_3.Start,
    NullGaps=False)
unit_y_5 = UnitY(Factor=subtraction_7)
move_21 = Move(Geometry=end_points_3.Start, Motion=vector_2pt.Vector)  # -> Geometry, Transform
move_22 = Move(Geometry=end_points_3.End, Motion=vector_2pt_2.Vector)  # -> Geometry, Transform
move_23 = Move(Geometry=move_10.Geometry, Motion=vector_2pt_2.Vector)  # -> Geometry, Transform
move_24 = Move(Geometry=move_11.Geometry, Motion=vector_2pt_2.Vector)  # -> Geometry, Transform
move_25 = Move(Geometry=end_points_6.End, Motion=vector_2pt_2.Vector)  # -> Geometry, Transform

# ---- group: truss cruve
move_26 = Move(Geometry=move_15.Geometry, Motion=unit_y_5)  # -> Geometry, Transform
move_27 = Move(Geometry=move_26.Geometry, Motion=unit_y_4)  # -> Geometry, Transform
move_28 = Move(Geometry=arc_3pt.Arc, Motion=unit_y_5)  # -> Geometry, Transform
move_29 = Move(Geometry=move_28.Geometry, Motion=unit_y_4)  # -> Geometry, Transform

# ----
polyline_4 = PolyLine(Vertices=weave_7, Closed=False)
polyline_5 = PolyLine(Vertices=weave_8, Closed=False)
weave_9 = Weave(
    Pattern=[0, 1, 2, 3, 4, 5],
    Stream0=move_17.Geometry,
    Stream1=move_16.Geometry,
    Stream2=move_18.Geometry,
    Stream3=move_19.Geometry,
    Stream4=move_20.Geometry,
    Stream5=move_17.Geometry,
    NullGaps=False)
weave_10 = Weave(
    Pattern=[0, 1, 2, 3, 4, 5],
    Stream0=move_21.Geometry,
    Stream1=move_22.Geometry,
    Stream2=move_23.Geometry,
    Stream3=move_24.Geometry,
    Stream4=move_25.Geometry,
    Stream5=move_21.Geometry,
    NullGaps=False)
end_points_12 = EndPoints(Curve=move_26.Geometry)  # -> Start, End
yz_plane = YZPlane(Origin=end_points_12.Start)
dispatch_5 = Dispatch(List=data_10, DispatchPattern=[True, False])  # -> ListA, ListB
dispatch_6 = Dispatch(List=data_11, DispatchPattern=[True, False])  # -> ListA, ListB
polyline_6 = PolyLine(Vertices=weave_9, Closed=False)
polyline_7 = PolyLine(Vertices=weave_10, Closed=False)
loft_2 = Loft(
    Curves=[polyline_6, polyline_4],
    Options={Adjust=False, Closed=False, LoftEnds=0, LoftSimp=0, LoftType=0, Rebuild=10, Refit=0.01})
loft_3 = Loft(
    Curves=[polyline_5, polyline_7],
    Options={Adjust=False, Closed=False, LoftEnds=0, LoftSimp=0, LoftType=0, Rebuild=10, Refit=0.01})
rectangle = Rectangle(Plane=yz_plane, XSize=multiplication_7, YSize=multiplication_11, Radius=0)  # -> Rectangle, Length
data_15 = Data(dispatch_5.ListB)

# ---- group: SUPPORT
cap_holes_ex = CapHolesEx(Brep=loft_2)  # -> Brep, Caps, Solid
cap_holes_ex_2 = CapHolesEx(Brep=loft_3)  # -> Brep, Caps, Solid

# ----
data_16 = Data(dispatch_6.ListB)
area_3 = Area(Geometry=rectangle.Rectangle)  # -> Area, Centroid
data_17 = Data(move_28.Geometry)
project_point = ProjectPoint(Point=data_16, Direction=unit_z_3, Geometry=move_28.Geometry)  # -> Point, Index
project_point_2 = ProjectPoint(Point=data_16, Direction=unit_z_3, Geometry=move_26.Geometry)  # -> Point, Index
project_point_3 = ProjectPoint(Point=data_15, Direction=unit_z_3, Geometry=move_27.Geometry)  # -> Point, Index
project_point_4 = ProjectPoint(Point=data_15, Direction=unit_z_3, Geometry=move_29.Geometry)  # -> Point, Index
box_mapping_3 = BoxMapping(Geometry=group_3, Source=group_3, Target=cap_holes_ex.Brep)  # -> Geometry, Transform
vector_2pt_5 = Vector2Pt(PointA=area_3.Centroid, PointB=end_points_12.Start, Unitize=False)  # -> Vector, Length
move_30 = Move(Geometry=rectangle.Rectangle, Motion=vector_2pt_5.Vector)  # -> Geometry, Transform
evaluate_curve = EvaluateCurve(Curve=data_17, Parameter=0)  # -> Point, Tangent, Angle
box_mapping_4 = BoxMapping(Geometry=geometry_2, Source=geometry_2, Target=cap_holes_ex_2.Brep)  # -> Geometry, Transform
end_points_13 = EndPoints(Curve=data_17)  # -> Start, End
weave_11 = Weave(Pattern=[0, 1], Stream0=project_point_2.Point, Stream1=project_point.Point, NullGaps=False)
weave_12 = Weave(Pattern=[0, 1], Stream0=project_point_3.Point, Stream1=project_point_4.Point, NullGaps=False)

# ---- group: column crv
line_6 = Line(StartPoint=data_15, EndPoint=project_point_4.Point)
line_7 = Line(StartPoint=data_16, EndPoint=project_point.Point)

# ----
plane_normal = PlaneNormal(Origin=end_points_13.Start, ZAxis=evaluate_curve.Tangent)
extrude_along = ExtrudeAlong(Base=move_30.Geometry, Curve=move_26.Geometry)
list_length = ListLength(List=line_7)

# ---- group: web crv
polyline_8 = PolyLine(Vertices=weave_11, Closed=False)
polyline_9 = PolyLine(Vertices=weave_12, Closed=False)
explode = Explode(Curve=polyline_8, Recursive=True)  # -> Segments, Vertices
explode_2 = Explode(Curve=polyline_9, Recursive=True)  # -> Segments, Vertices

# ----
orient = Orient(Geometry=move_30.Geometry, Source=move_30.Geometry, Target=plane_normal)  # -> Geometry, Transform
subtraction_9 = Subtraction(A=list_length, B=1)
range_6 = Range(Domain=construct_domain_4, Steps=subtraction_9)
area_4 = Area(Geometry=orient.Geometry)  # -> Area, Centroid
data_18 = Data(data_16)
extend_curve = ExtendCurve(Curve=line_6, Type=0, Start=multiplication_15, End=range_6)
extend_curve_2 = ExtendCurve(Curve=line_7, Type=0, Start=multiplication_15, End=range_6)
data_19 = Data(project_point_3.Point)
data_20 = Data(data_15)
data_21 = Data(move_29.Geometry)
data_22 = Data(move_28.Geometry)
data_23 = Data(project_point_2.Point)
pipe = Pipe(Curve=[explode_2.Segments, explode.Segments], Radius=multiplication_13, Caps=1)
pipe_2 = Pipe(Curve=extend_curve, Radius=multiplication_14, Caps=1)
pipe_3 = Pipe(Curve=extend_curve_2, Radius=multiplication_14, Caps=1)
vector_2pt_6 = Vector2Pt(PointA=area_4.Centroid, PointB=end_points_13.Start, Unitize=False)  # -> Vector, Length
end_points_14 = EndPoints(Curve=data_21)  # -> Start, End
end_points_15 = EndPoints(Curve=data_22)  # -> Start, End
data_24 = Data(project_point_4.Point)
move_31 = Move(Geometry=data_20, Motion=unit_z_5)  # -> Geometry, Transform
data_25 = Data(project_point.Point)
move_32 = Move(Geometry=orient.Geometry, Motion=vector_2pt_6.Vector)  # -> Geometry, Transform
move_33 = Move(Geometry=data_18, Motion=unit_z_5)  # -> Geometry, Transform
explode_object = ExplodeObject(Object=pipe_2, Recursive=False)
explode_object_2 = ExplodeObject(Object=pipe_3, Recursive=False)
merge_2 = Merge(Data1=end_points_14.Start, Data2=data_24, Data3=end_points_14.End)
merge_3 = Merge(Data1=end_points_15.Start, Data2=data_25, Data3=end_points_15.End)
rotate = Rotate(Geometry=move_32.Geometry, Angle=1.570796327, Plane=plane_normal)  # -> Geometry, Transform
line_8 = Line(StartPoint=move_33.Geometry, EndPoint=data_23)
line_9 = Line(StartPoint=move_31.Geometry, EndPoint=data_19)
list_item_20 = ListItem(List=explode_object, Index=2, Wrap=True)  # -> flatten(Item)
list_item_21 = ListItem(List=explode_object_2, Index=2, Wrap=True)  # -> flatten(Item)
move_34 = Move(Geometry=rotate.Geometry, Motion=unit_y_4)  # -> Geometry, Transform
polyline_10 = PolyLine(Vertices=merge_3, Closed=False)
polyline_11 = PolyLine(Vertices=merge_2, Closed=False)
dispatch_7 = Dispatch(List=list_item_20, DispatchPattern=[True, False])  # -> ListA, ListB
dispatch_8 = Dispatch(List=list_item_21, DispatchPattern=[True, False])  # -> ListA, ListB
sweep1 = Sweep1(Rail=data_17, Sections=rotate.Geometry, Miter=1)

# ---- group: chord 1
cap_holes_ex_3 = CapHolesEx(Brep=extrude_along)  # -> Brep, Caps, Solid
move_35 = Move(Geometry=cap_holes_ex_3.Brep, Motion=unit_y_4)  # -> Geometry, Transform
cap_holes_ex_4 = CapHolesEx(Brep=sweep1)  # -> Brep, Caps, Solid
move_36 = Move(Geometry=cap_holes_ex_4.Brep, Motion=unit_y_4)  # -> Geometry, Transform

# ----
pipe_4 = Pipe(Curve=[line_9, line_8], Radius=multiplication_9, Caps=0)

# ---- group: chord 2
sweep1_2 = Sweep1(Rail=polyline_10, Sections=rotate.Geometry, Miter=1)
sweep1_3 = Sweep1(Rail=polyline_11, Sections=move_34.Geometry, Miter=1)

# ----
cap_holes_ex_5 = CapHolesEx(Brep=pipe_4)  # -> Brep, Caps, Solid
merge_4 = Merge(Data1=dispatch_8.ListB, Data2=dispatch_7.ListA)
merge_5 = Merge(Data1=dispatch_8.ListA, Data2=dispatch_7.ListB)
list_length_2 = ListLength(List=flatten(merge_5))
random = Random(Range=construct_domain_5, Number=list_length_2, Seed=balloon_seed)  # -> flatten(Random)
list_item_22 = ListItem(List=random, Index=0, Wrap=True)
unit_z_6 = UnitZ(Factor=random)
box_mapping_5 = BoxMapping(Geometry=group_4, Source=group_4, Target=cap_holes_ex_5.Brep)  # -> Geometry, Transform
area_5 = Area(Geometry=merge_4)  # -> Area, Centroid
unit_z_7 = UnitZ(Factor=list_item_22)
area_6 = Area(Geometry=merge_5)  # -> Area, Centroid
move_37 = Move(Geometry=area_6.Centroid, Motion=unit_z_6)  # -> Geometry, Transform
move_38 = Move(Geometry=area_5.Centroid, Motion=unit_z_7)  # -> Geometry, Transform
sphere = Sphere(Base=move_37.Geometry, Radius=random)
sphere_2 = Sphere(Base=move_38.Geometry, Radius=list_item_22)
box_mapping_6 = BoxMapping(Geometry=group_5, Source=group_5, Target=sphere_2)  # -> Geometry, Transform
box_mapping_7 = BoxMapping(Geometry=group_6, Source=group_6, Target=sphere)  # -> Geometry, Transform
