# Grasshopper definition assignment 1 FENCE POST Kevin.ghx (Grasshopper 1.0.8)

fence_height = Slider(0.5, range=-0.5..0.5)
post_no = Slider(4, range=4..8)
post_distance = Slider(0.08, range=0..0.2)
post_shape = Slider(5, range=4..6)
post_r = Slider(0.015, range=0.01..0.02)
curve = Slider(5, range=1..5)
rotate = Slider(8, range=0..8)
extrude = Slider(1, range=0..1)
construct_point = ConstructPoint(XCoordinate=0, YCoordinate=0, ZCoordinate=0)
multiplication = Multiplication(A=extrude, B=-1000)
multiplication_2 = Multiplication(A=fence_height, B=1000)
multiplication_3 = Multiplication(A=post_r, B=1000)
multiplication_4 = Multiplication(A=post_distance, B=1000)
unit_z = UnitZ(Factor=multiplication_2)
move = Move(Geometry=construct_point, Motion=unit_z)  # -> Geometry, Transform
line = Line(StartPoint=construct_point, EndPoint=move.Geometry)
radial = Radial(Plane=construct_point, Size=multiplication_4, ExtentR=1, ExtentP=post_no)  # -> Cells, Points
area = Area(Geometry=radial.Cells)
line_2 = Line(StartPoint=construct_point, EndPoint=area)
polyline = PolyLine(Vertices=area, Closed=True)
explode = Explode(Curve=polyline, Recursive=True)  # -> Segments, Vertices
data = Data(construct_point)
data_2 = Data(area)
line_line = LineLine(LineA=explode.Segments, LineB=line_2)
construct_domain = ConstructDomain(DomainStart=0, DomainEnd=1)
move_2 = Move(Geometry=data_2, Motion=unit_z)  # -> Geometry, Transform
radial_2 = Radial(Plane=line_line, Size=multiplication_3, ExtentR=1, ExtentP=post_shape)  # -> Cells, Points
range = Range(Domain=construct_domain, Steps=Slider(50, range=20..100))
region_union = RegionUnion(Curves=radial_2.Cells)
line_3 = Line(StartPoint=data_2, EndPoint=move_2.Geometry)  # -> graft(Line)
data_3 = Data(line)
move_3 = Move(Geometry=region_union, Motion=unit_z)  # -> Geometry, Transform
evaluate_curve = EvaluateCurve(Curve=reparameterize(line_3), Parameter=range)  # -> Point, Tangent, Angle
evaluate_curve_2 = EvaluateCurve(Curve=reparameterize(data_3), Parameter=range)  # -> Point, Tangent, Angle
curve_middle = CurveMiddle(Curve=data_3)
distance = Distance(PointA=evaluate_curve.Point, PointB=data)
multiplication_5 = Multiplication(A=rotate, B=45)
distance_2 = Distance(PointA=evaluate_curve.Point, PointB=curve_middle)
construct_domain_2 = ConstructDomain(DomainStart=0, DomainEnd=multiplication_5)
bounds = Bounds(Numbers=flatten(distance))
bounds_2 = Bounds(Numbers=distance_2)
construct_domain_3 = ConstructDomain(DomainStart=curve, DomainEnd=1)
remap_numbers = RemapNumbers(Value=distance, Source=bounds, Target=construct_domain_2)  # -> Mapped, Clipped
remap_numbers_2 = RemapNumbers(Value=distance_2, Source=bounds_2, Target=construct_domain_3)  # -> Mapped, Clipped
graph_mapper = GraphMapper(remap_numbers_2.Mapped, x0=1, x1=5, y0=1, y1=5, Cx=0.688337326, Cy=0.2679545283, container_name="Conic")
scale = Scale(Geometry=evaluate_curve.Point, Center=evaluate_curve_2.Point, Factor=graph_mapper)  # -> Geometry, Transform
rotate_2 = Rotate(Geometry=scale.Geometry, Angle=degrees(remap_numbers.Mapped), Plane=PlaneXY(0, 0, 0))  # -> Geometry, Transform
panel = Panel(remap_numbers_2.Mapped)
polyline_2 = PolyLine(Vertices=rotate_2.Geometry, Closed=False)
sweep1 = Sweep1(Rail=polyline_2, Sections=region_union, Miter=1)
cap_holes_ex = CapHolesEx(Brep=sweep1)  # -> Brep, Caps, Solid
panel_2 = Panel(graph_mapper)
data_4 = Data(region_union)
unit_z_2 = UnitZ(Factor=multiplication)
extrude_2 = Extrude(Base=data_4, Direction=unit_z_2)
cap_holes_ex_2 = CapHolesEx(Brep=extrude_2)  # -> Brep, Caps, Solid
mirror = Mirror(Geometry=cap_holes_ex_2.Brep, Plane=curve_middle)  # -> Geometry, Transform
data_5 = Data(cap_holes_ex.Brep)
group = Group(Objects=[mirror.Geometry, cap_holes_ex_2.Brep, data_5])
