# Grasshopper definition assignment 1 Songnan MAPPING stair.ghx (Grasshopper 1.0.8)

number_slider = Slider(3000, range=0..3000)
内径 = Slider(1000, range=0..10000)
division = Division(A=number_slider, B=Slider(20, range=0..20))
dom = ConstructDomain(DomainStart=Slider(0, range=0..1000), DomainEnd=number_slider)
pt = ConstructPoint(XCoordinate=内径, YCoordinate=0, ZCoordinate=0)
range = Range(Domain=dom, Steps=division)
xy = XYPlane(Origin=Point(0, 0, 0))
rotate = Rotate(Geometry=pt, Angle=degrees(range), Plane=xy)  # -> Geometry, Transform
Z = UnitZ(Factor=range)
踏板数量before_landing = Slider(5, range=0..20)
landing宽度 = Slider(0, range=0..2000)
treads宽度 = Slider(300, range=0..1000)
treads数量 = Slider(30, range=0..100)
move = Move(Geometry=rotate.Geometry, Motion=Z)  # -> Geometry, Transform
intcrv = Interpolate(Vertices=rotate.Geometry, Degree=3, Periodic=False, KnotStyle=1)  # -> Curve, Length, Domain
repeat = RepeatData(Data=treads宽度, Length=踏板数量before_landing)
merge = Merge(Data1=flatten(repeat), Data2=flatten(landing宽度))
repeat_2 = RepeatData(Data=merge, Length=treads数量)
len = Length(Curve=intcrv.Curve)
ma = MassAddition(Input=repeat_2)  # -> Result, PartialResults
panel = Panel(repeat_2)
division_2 = Division(A=ma.PartialResults, B=len)
shatter = Shatter(Curve=reparameterize(intcrv.Curve), Parameters=division_2)
cull_i = CullIndex(List=shatter, Indices="-1", Wrap=True)

# ----
# Teads
外径 = Slider(2, range=1..5)
scale = Scale(Geometry=cull_i, Center=Point(0, 0, 0), Factor=外径)  # -> Geometry, Transform
treads厚度 = Slider(35, range=0..100)
rulesrf = RuledSurface(CurveA=cull_i, CurveB=scale.Geometry)
lng = ListLength(List=rulesrf)
series = Series(Start="150", Step="150", Count=lng)
Z_2 = UnitZ(Factor=series)
move_2 = Move(Geometry=rulesrf, Motion=Z_2)  # -> Geometry, Transform
Z_3 = UnitZ(Factor=treads厚度)
panel_2 = Panel(series)
extr = Extrude(Base=move_2.Geometry, Direction=Z_3)

# ----
# Handrail
number_slider_2 = Slider(0, range=-2000..10000)
number_slider_3 = Slider(0, range=-2000..10000)
handrail_height = Slider(1100, range=0..10000)
handrail_diameter = Slider(100, range=0..1000)
construct_point = ConstructPoint(XCoordinate=0, YCoordinate=0, ZCoordinate=0)
unit_z = UnitZ(Factor=handrail_height)
circle = Circle(Plane=construct_point, Radius=handrail_diameter)
extrude = Extrude(Base=circle, Direction=unit_z)
brep = Brep([<brep referenced from the Rhino model> x15])
move_3 = Move(Geometry=brep, Motion="0,0,0")  # -> Geometry, Transform
group = Group(Objects=move_3.Geometry)
cap_holes_ex = CapHolesEx(Brep=extrude)  # -> Brep, Caps, Solid
box_mapping = BoxMapping(Geometry=group, Source=group, Target=cap_holes_ex.Brep)  # -> Geometry, Transform
geo = Geometry(box_mapping.Geometry)
number_slider_4 = Slider(0.15, range=0..1)
螺旋桨柱高度 = Slider(1300, range=0..2000)
move_4 = Move(Geometry=cull_i, Motion=Z_2)  # -> Geometry, Transform
栏杆高度 = Slider(0, range=0..10000)
crv = Curve(move_4.Geometry)
offset = OffsetCurve(Curve=crv, Distance=Slider(1000, range=0..10000), Corners=1)
Z_4 = UnitZ(Factor=螺旋桨柱高度)
panel_3 = Panel("""0
0
0
0
0
0
0
0
0
0
0
0
0
0
0
0
0""")
crv_2 = Curve(<curve referenced from the Rhino model>)
hframe = HorizontalFrame(Curve=reparameterize(offset), Parameter=number_slider_4)
hframe_2 = HorizontalFrame(Curve=reparameterize(crv), Parameter=number_slider_4)
Z_5 = UnitZ(Factor=栏杆高度)
xy_2 = XYPlane(Origin=Point(0, 0, 0))
extr_2 = Extrude(Base=crv_2, Direction=Z_4)
dispatch = Dispatch(List=hframe_2, DispatchPattern=panel_3)  # -> ListA, ListB
move_5 = Move(Geometry=hframe, Motion=Z_5)  # -> Geometry, Transform
move_6 = Move(Geometry=hframe_2, Motion=Z_5)  # -> Geometry, Transform
xy_3 = XYPlane(Origin=Point(0, 0, 0))
xy_4 = XYPlane(Origin=Point(0, 0, 0))
orient = Orient(Geometry=extr_2, Source=xy_2, Target=[move_6.Geometry, move_5.Geometry])  # -> Geometry, Transform
orient_2 = Orient(Geometry=geo, Source=xy_4, Target=dispatch.ListB)  # -> Geometry, Transform
panel_4 = Panel("""0
0
0
0
0
0
0
0
0
0
0
0
0
0
0
0
1""")
dispatch_2 = Dispatch(List=hframe, DispatchPattern=panel_4)  # -> ListA, ListB
orient_3 = Orient(Geometry=geo, Source=xy_3, Target=dispatch_2.ListB)  # -> Geometry, Transform
螺旋柱height = Slider(1150, range=0..10000)
handrail_height_2 = Slider(1180, range=0..10000)
Z_6 = UnitZ(Factor=螺旋柱height)
crv_3 = Curve(<curve referenced from the Rhino model>)
unit_z_2 = UnitZ(Factor=handrail_height_2)
extrude_2 = Extrude(Base=circle, Direction=unit_z_2)
hframe_3 = HorizontalFrame(Curve=reparameterize(offset), Parameter=Slider(0.65, range=0..1))
move_7 = Move(Geometry=hframe_3, Motion=Z_5)  # -> Geometry, Transform
extr_3 = Extrude(Base=crv_3, Direction=Z_6)
dispatch_3 = Dispatch(List=hframe_3, DispatchPattern=panel_4)  # -> ListA, ListB
orient_4 = Orient(Geometry=extr_3, Source=xy_2, Target=move_7.Geometry)  # -> Geometry, Transform
cap_holes_ex_2 = CapHolesEx(Brep=extrude_2)  # -> Brep, Caps, Solid
xy_5 = XYPlane(Origin=Point(0, 0, 0))
brep_2 = Brep([<brep referenced from the Rhino model> x15])
move_8 = Move(Geometry=brep_2, Motion="0,0,0")  # -> Geometry, Transform
group_2 = Group(Objects=move_8.Geometry)
box_mapping_2 = BoxMapping(Geometry=group_2, Source=group_2, Target=cap_holes_ex_2.Brep)  # -> Geometry, Transform
geo_2 = Geometry(box_mapping_2.Geometry)
orient_5 = Orient(Geometry=geo_2, Source=xy_5, Target=dispatch_3.ListB)  # -> Geometry, Transform

# ----
# Propeller
hframe_4 = HorizontalFrame(Curve=reparameterize(crv), Parameter=number_slider_4)
hframe_5 = HorizontalFrame(Curve=reparameterize(offset), Parameter=number_slider_4)
move_9 = Move(Geometry=hframe_5, Motion=Z_4)  # -> Geometry, Transform
move_10 = Move(Geometry=hframe_4, Motion=Z_4)  # -> Geometry, Transform
geo_3 = Geometry(<mesh referenced from the Rhino model>)
xy_6 = XYPlane(Origin=Point(0, 0, 0))
geo_4 = Geometry(<mesh referenced from the Rhino model>)
orient_6 = Orient(Geometry=geo_3, Source=xy_6, Target=move_9.Geometry)  # -> Geometry, Transform
orient_7 = Orient(Geometry=geo_4, Source=xy_6, Target=move_10.Geometry)  # -> Geometry, Transform

# ----
# Treads Texture
brep_3 = Brep([<brep referenced from the Rhino model> x104])
brep_4 = Brep([<brep referenced from the Rhino model> x104])
group_3 = Group(Objects=brep_3)
group_4 = Group(Objects=brep_4)
xy_7 = XYPlane(Origin=Point(0, 0, 0))
xy_8 = XYPlane(Origin=Point(0, 0, 0))
surface_box = SurfaceBox(Surface=move_2.Geometry, Domain=move_2.Geometry, Height=treads厚度)
panel_5 = Panel("""15
31""")
panel_6 = Panel("""15
31""")
bounding_box = BoundingBox(Content=group_4, Plane=xy_7)  # -> Box, Box_2
bounding_box_2 = BoundingBox(Content=group_3, Plane=xy_8)  # -> Box, Box_2
item = ListItem(List=surface_box, Index=panel_5, Wrap=True)
cull_i_2 = CullIndex(List=surface_box, Indices=panel_6, Wrap=True)
box_morph = BoxMorph(Geometry=group_3, Reference=bounding_box_2.Box, Target=item)
box_morph_2 = BoxMorph(Geometry=group_4, Reference=bounding_box.Box, Target=cull_i_2)

# ----
# Edge&Top Rail
number_slider_5 = Slider(1100, range=0..10000)
Z_7 = UnitZ(Factor=1)
pt_2 = Point(<point referenced from the Rhino model>)
line = LineSDL(Start=pt_2, Direction=Z_7, Length=number_slider_5)
楼梯边沿高度 = Slider(-300, range=-300..1000)
orient_8 = Orient(Geometry=line, Source=PlaneXY(0, 0, 0), Target=dispatch.ListB)  # -> Geometry, Transform
xy_9 = XYPlane(Origin=Point(0, 0, 0))
end = EndPoints(Curve=orient_8.Geometry)  # -> Start, End
xy_10 = XYPlane(Origin=Point(0, 0, 0))
扶手厚度 = Slider(40, range=0..1000)
intcrv_2 = Interpolate(Vertices=end.Start, Degree=3, Periodic=False, KnotStyle=1)  # -> Curve, Length, Domain
offset_l = OffsetCurveLoose(Curve=intcrv_2.Curve, Distance=Slider(1000, range=0..1000), Plane=xy_9)
intcrv_3 = Interpolate(Vertices=end.End, Degree=3, Periodic=False, KnotStyle=1)  # -> Curve, Length, Domain
Z_8 = UnitZ(Factor=楼梯边沿高度)
offset_l_2 = OffsetCurveLoose(Curve=intcrv_3.Curve, Distance=Slider(1000, range=0..1000), Plane=xy_10)
楼梯边沿厚度 = Slider(50, range=-20..100)
楼梯边沿厚度_2 = Slider(-50, range=-200..100)
pipe = Pipe(Curve=offset_l_2, Radius=扶手厚度, Caps=0)
extr_4 = Extrude(Base=offset_l, Direction=Z_8)
pipe_2 = Pipe(Curve=intcrv_3.Curve, Radius=扶手厚度, Caps=0)
extr_5 = Extrude(Base=intcrv_2.Curve, Direction=Z_8)
楼梯边沿移动 = Slider(80, range=0..200)
offset_2 = OffsetSurface(Surface=extr_5, Distance=楼梯边沿厚度_2, Retrim=True)
offset_3 = OffsetSurface(Surface=extr_4, Distance=楼梯边沿厚度, Retrim=True)
join = BrepJoin(Breps=[offset_3, extr_4])  # -> Breps, Closed
join_2 = BrepJoin(Breps=[extr_5, offset_2])  # -> Breps, Closed
loft = Loft(Curves=join.Breps, Options={Adjust=False, Closed=False, LoftEnds=0, LoftSimp=0, LoftType=0, Rebuild=10, Refit=0.01})
loft_2 = Loft(Curves=join_2.Breps, Options={Adjust=False, Closed=False, LoftEnds=0, LoftSimp=0, LoftType=0, Rebuild=10, Refit=0.01})
join_3 = BrepJoin(Breps=[join_2.Breps, loft_2])  # -> Breps, Closed
Z_9 = UnitZ(Factor=楼梯边沿移动)
join_4 = BrepJoin(Breps=[join.Breps, loft])  # -> Breps, Closed
move_11 = Move(Geometry=join_3.Breps, Motion=Z_9)  # -> Geometry, Transform
move_12 = Move(Geometry=join_4.Breps, Motion=Z_9)  # -> Geometry, Transform

arch下高度 = Slider(80, range=0..1000)

# ----
# Arch
arch高度 = Slider(-150, range=-200..1000)
debrep = DeconstructBrep(Brep=extr)  # -> Faces, Edges, Vertices
arch支撑数量 = Slider(12, range=0..20)
item_2 = ListItem(List=debrep.Edges, Index="0", Wrap=True)
Z_10 = UnitZ(Factor=arch高度)
move_13 = Move(Geometry=item_2, Motion=Z_10)  # -> Geometry, Transform
reb = RebuildCurve(Curve=move_13.Geometry, Degree=Slider(2, range=0..100), Count=Slider(0, range=0..1000), Tangents=False)
cp = ControlPoints(Curve=reb)  # -> Points, Weights, Knots
panel_7 = Panel("""0
2""")
panel_8 = Panel("""0
1""")
divide = DivideCurve(Curve=item_2, Count=arch支撑数量, Kinks=False)  # -> Points, Tangents, Parameters
item_3 = ListItem(List=cp.Points, Index="1", Wrap=True)
item_4 = ListItem(List=cp.Points, Index="1", Wrap=True)
Z_11 = UnitZ(Factor=arch下高度)
move_14 = Move(Geometry=item_3, Motion=Z_11)  # -> Geometry, Transform
item_5 = ListItem(List=cp.Points, Index=panel_7, Wrap=True)
dispatch_4 = Dispatch(List=divide.Points, DispatchPattern=panel_8)  # -> ListA, ListB
weave = Weave(Pattern=[0, 1], Stream0=item_5, Stream1=move_14.Geometry, NullGaps=False)
pt_3 = Point(dispatch_4.ListA)
intcrv_4 = Interpolate(Vertices=weave, Degree=3, Periodic=False, KnotStyle=1)  # -> Curve, Length, Domain
divide_2 = DivideCurve(Curve=intcrv_4.Curve, Count=arch支撑数量, Kinks=False)  # -> Points, Tangents, Parameters
dispatch_5 = Dispatch(List=divide_2.Points, DispatchPattern=panel_8)  # -> ListA, ListB
pt_4 = Point(dispatch_5.ListB)
weave_2 = Weave(Pattern=panel_8, Stream0=pt_4, Stream1=pt_3, NullGaps=False)
ln = Line(StartPoint=divide.Points, EndPoint=divide_2.Points)
pline = PolyLine(Vertices=weave_2, Closed=False)
pipe_3 = Pipe(Curve=[pline, ln, intcrv_4.Curve], Radius=Slider(8, range=0..100), Caps=0)
