# Grasshopper definition assignment 1 background.ghx (Grasshopper 1.0.8)

curve = Curve([<curve referenced from the Rhino model> x483])
multiplication = Multiplication(A=Slider(20, range=0..100), B=1000)
multiplication_2 = Multiplication(A=Slider(9, range=0..100), B=1000)
construct_domain = ConstructDomain(DomainStart=multiplication_2, DomainEnd=multiplication)
list_length = ListLength(List=curve)
random = Random(Range=construct_domain, Number=list_length, Seed=2)
unit_z = UnitZ(Factor=random)
extrude = Extrude(Base=curve, Direction=unit_z)  # -> graft(Extrusion)
cap_holes_ex = CapHolesEx(Brep=extrude)  # -> Brep, Caps, Solid
panel = Panel(random)
panel_2 = Panel(curve)
