# Grasshopper definition assignment 1 cladding Kevin.ghx (Grasshopper 1.0.8)

grid_thickness_cm = Slider(6, range=0..10)
length = Slider(2, range=0..2)
width = Slider(1, range=0..1)
grid_count = Slider(97, range=50..150)
thickness = Slider(0.045, range=0.02..0.1)
pull_distance = Slider(5, range=5..10)
traingle = Slider(0.206, range=0..0.45)
number_slider = Slider(2, range=0..10)  # disabled
length_2 = Slider(2, range=0..2)  # disabled
width_2 = Slider(1, range=0..1)  # disabled
trim = Slider(0.17, range=0.1..0.3)  # disabled
multiplication = Multiplication(A=length, B=1000)
multiplication_2 = Multiplication(A=width, B=1000)
multiplication_3 = Multiplication(A=number_slider, B=1000)  # disabled
multiplication_4 = Multiplication(A=length_2, B=1000)  # disabled
multiplication_5 = Multiplication(A=width_2, B=1000)  # disabled
rectangular = Rectangular(Plane=PlaneXY(0, 0, 0), SizeX=multiplication, SizeY=multiplication_2, ExtentX=1, ExtentY=1)  # -> Cells, Points
construct_point = ConstructPoint(XCoordinate=0, YCoordinate=multiplication_3, ZCoordinate=0)  # disabled
explode_object = ExplodeObject(Object=rectangular.Cells, Recursive=False)
rectangular_2 = Rectangular(Plane=construct_point, SizeX=multiplication_4, SizeY=multiplication_5, ExtentX=1, ExtentY=1)  # -> Cells, Points; disabled
list_item = ListItem(List=explode_object, Index=3, Wrap=True)
list_item_2 = ListItem(List=explode_object, Index=1, Wrap=True)
boundary_surfaces = BoundarySurfaces(Edges=rectangular_2.Cells)  # disabled
explode = Explode(Curve=rectangular_2.Cells, Recursive=True)  # -> Segments, Vertices; disabled
subtraction = Subtraction(A=1, B=traingle)
end_points = EndPoints(Curve=list_item)  # -> Start, End
evaluate_curve = EvaluateCurve(Curve=reparameterize(list_item_2), Parameter=traingle)  # -> Point, Tangent, Angle
evaluate_curve_2 = EvaluateCurve(Curve=reparameterize(list_item_2), Parameter=subtraction)  # -> Point, Tangent, Angle
populate_2d = Populate2D(Region=boundary_surfaces, Count=grid_count, Seed=1)  # disabled
list_item_3 = ListItem(List=explode.Segments, Index=3, Wrap=True)  # disabled
list_item_4 = ListItem(List=explode.Segments, Index=1, Wrap=True)  # disabled
list_item_5 = ListItem(List=explode.Segments, Index=0, Wrap=True)  # disabled
list_item_6 = ListItem(List=explode.Segments, Index=2, Wrap=True)  # disabled
list_item_7 = ListItem(List=explode.Vertices, Index=1, Wrap=True)  # disabled
list_item_8 = ListItem(List=explode.Vertices, Index=3, Wrap=True)  # disabled
merge = Merge(Data1=end_points.End, Data2=evaluate_curve.Point, Data3=evaluate_curve_2.Point, Data4=end_points.Start)
line = Line(StartPoint=list_item_7, EndPoint=list_item_8)  # disabled
merge_2 = Merge(Data1=list_item_3, Data2=list_item_5, Data3=line)  # disabled
merge_3 = Merge(Data1=list_item_4, Data2=list_item_6, Data3=line)  # disabled
polyline = PolyLine(Vertices=merge, Closed=True)
join_curves = JoinCurves(Curves=merge_2, Preserve=False)  # disabled
join_curves_2 = JoinCurves(Curves=merge_3, Preserve=False)  # disabled
curve_middle = CurveMiddle(Curve=line)  # disabled
distance = Distance(PointA=populate_2d, PointB=curve_middle)  # disabled
bounds = Bounds(Numbers=distance)  # disabled
line_2 = Line(StartPoint=end_points.Start, EndPoint=evaluate_curve.Point)
line_3 = Line(StartPoint=end_points.End, EndPoint=evaluate_curve_2.Point)
explode_2 = Explode(Curve=polyline, Recursive=True)  # -> Segments, Vertices
data = Data(multiplication)
boundary_surfaces_2 = BoundarySurfaces(Edges=join_curves)  # disabled
boundary_surfaces_3 = BoundarySurfaces(Edges=join_curves_2)  # disabled
circle_tantan = CircleTanTan(CurveA=list_item_5, CurveB=list_item_6, Point=curve_middle)  # disabled
curve_curve = CurveCurve(CurveA=line_2, CurveB=line_3)  # -> Points, ParamsA, ParamsB
multiplication_6 = Multiplication(A=data, B=-1)
list_item_9 = ListItem(List=explode_2.Segments, Index=0, Wrap=True)
list_item_10 = ListItem(List=explode_2.Segments, Index=1, Wrap=True)
list_item_11 = ListItem(List=explode_2.Segments, Index=2, Wrap=True)
scale = Scale(Geometry=boundary_surfaces_2, Center=list_item_7, Factor=trim)  # -> Geometry, Transform; disabled
scale_2 = Scale(Geometry=boundary_surfaces_3, Center=list_item_8, Factor=trim)  # -> Geometry, Transform; disabled
unit_x = UnitX(Factor=multiplication_6)
circle_tantan_2 = CircleTanTan(CurveA=list_item_9, CurveB=list_item_11, Point=curve_curve.Points)
move = Move(Geometry=list_item_10, Motion=unit_x)  # -> Geometry, Transform
solid_difference = SolidDifference(BrepsA=boundary_surfaces_3, BrepsB=scale_2.Geometry)  # disabled
solid_difference_2 = SolidDifference(BrepsA=boundary_surfaces_2, BrepsB=scale.Geometry)  # disabled
multiplication_7 = Multiplication(A=thickness, B=-1000)
offset_curve = OffsetCurve(Curve=rectangular_2.Cells, Distance=multiplication_7, Corners=1)  # disabled
voronoi = Voronoi(Points=populate_2d, Boundary=offset_curve, BruteForceOverride=False)  # -> graft(Cells); disabled
boundary_surfaces_4 = BoundarySurfaces(Edges=voronoi)  # disabled
multiplication_8 = Multiplication(A=multiplication_7, B=2)
offset_curve_2 = OffsetCurve(Curve=circle_tantan, Distance=multiplication_8, Corners=1)  # disabled
offset_curve_3 = OffsetCurve(Curve=circle_tantan, Distance=multiplication_7, Corners=1)  # disabled
unit_y = UnitY(Factor=multiplication_7)
multiplication_9 = Multiplication(A=thickness, B=1000)
unit_y_2 = UnitY(Factor=multiplication_9)
boundary_surfaces_5 = BoundarySurfaces(Edges=offset_curve_3)  # disabled
loft = Loft(
    Curves=[list_item_10, move.Geometry],
    Options={Adjust=False, Closed=False, LoftEnds=0, LoftSimp=0, LoftType=0, Rebuild=10, Refit=0.01})
move_2 = Move(Geometry=evaluate_curve_2.Point, Motion=unit_y)  # -> Geometry, Transform
move_3 = Move(Geometry=evaluate_curve.Point, Motion=unit_y_2)  # -> Geometry, Transform
brep_edges = BrepEdges(Brep=solid_difference)  # -> Naked, Interior, NonManifold; disabled
brep_edges_2 = BrepEdges(Brep=solid_difference_2)  # -> Naked, Interior, NonManifold; disabled
surface_split = SurfaceSplit(Surface=boundary_surfaces_5, Curves=offset_curve_2)  # disabled
data_2 = Data(end_points.Start)
data_3 = Data(end_points.End)
populate_2d_2 = Populate2D(Region=loft, Count=grid_count, Seed=1)
join_curves_3 = JoinCurves(Curves=brep_edges.Naked, Preserve=False)  # disabled
join_curves_4 = JoinCurves(Curves=brep_edges_2.Naked, Preserve=False)  # disabled
brep_edges_3 = BrepEdges(Brep=loft)  # -> Naked, Interior, NonManifold
line_4 = Line(StartPoint=data_3, EndPoint=move_2.Geometry)
line_5 = Line(StartPoint=data_2, EndPoint=move_3.Geometry)
list_item_12 = ListItem(List=surface_split, Index=0, Wrap=True)  # disabled
offset_curve_4 = OffsetCurve(Curve=join_curves_3, Distance=multiplication_7, Corners=1)  # disabled
offset_curve_5 = OffsetCurve(Curve=join_curves_4, Distance=multiplication_7, Corners=1)  # disabled
move_4 = Move(Geometry=line_5, Motion=unit_y)  # -> Geometry, Transform
move_5 = Move(Geometry=line_4, Motion=unit_y_2)  # -> Geometry, Transform
voronoi_2 = Voronoi(Points=populate_2d_2, Boundary=loft, BruteForceOverride=False)  # -> graft(Cells)
offset_curve_6 = OffsetCurve(Curve=polyline, Distance=multiplication_9, Corners=1)
offset_curve_7 = OffsetCurve(Curve=circle_tantan_2, Distance=multiplication_7, Corners=1)
surface_split_2 = SurfaceSplit(Surface=list_item_12, Curves=line)  # disabled
area = Area(Geometry=voronoi_2)  # -> Area, Centroid
area_2 = Area(Geometry=offset_curve_7)  # -> Area, Centroid
data_4 = Data(circle_tantan_2)
data_5 = Data(polyline)
multiplication_10 = Multiplication(A=grid_thickness_cm, B=-1)
offset_curve_8 = OffsetCurve(Curve=voronoi, Distance=multiplication_10, Corners=1)  # disabled
surface_split_3 = SurfaceSplit(Surface=boundary_surfaces_4, Curves=offset_curve_8)  # disabled
list_item_13 = ListItem(List=surface_split_3, Index=0, Wrap=True)  # -> flatten(Item); disabled
surface_split_4 = SurfaceSplit(Surface=solid_difference, Curves=offset_curve_4)  # disabled
surface_split_5 = SurfaceSplit(Surface=solid_difference_2, Curves=offset_curve_5)  # disabled
panel = Panel(voronoi_2)
unit_z = UnitZ(Factor=1)
distance_2 = Distance(PointA=area_2.Centroid, PointB=area.Centroid)
offset_curve_9 = OffsetCurve(Curve=voronoi_2, Distance=multiplication_10, Corners=1)
boundary_surfaces_6 = BoundarySurfaces(Edges=offset_curve_7)
boundary_surfaces_7 = BoundarySurfaces(Edges=data_4)
boundary_surfaces_8 = BoundarySurfaces(Edges=data_5)
boundary_surfaces_9 = BoundarySurfaces(Edges=offset_curve_6)
loft_2 = Loft(
    Curves=[line_5, move_4.Geometry],
    Options={Adjust=False, Closed=False, LoftEnds=0, LoftSimp=0, LoftType=0, Rebuild=10, Refit=0.01})  # -> flatten(Loft)
loft_3 = Loft(
    Curves=[line_4, move_5.Geometry],
    Options={Adjust=False, Closed=False, LoftEnds=0, LoftSimp=0, LoftType=0, Rebuild=10, Refit=0.01})  # -> flatten(Loft)
list_item_14 = ListItem(List=surface_split_5, Index=0, Wrap=True)  # disabled
list_item_15 = ListItem(List=surface_split_2, Index=0, Wrap=True)  # disabled
list_item_16 = ListItem(List=surface_split_4, Index=0, Wrap=True)  # disabled
bounds_2 = Bounds(Numbers=flatten(distance_2))
list_item_17 = ListItem(List=surface_split_2, Index=1, Wrap=True)  # disabled
solid_difference_3 = SolidDifference(BrepsA=boundary_surfaces_9, BrepsB=boundary_surfaces_8)  # -> flatten(Result)
solid_difference_4 = SolidDifference(BrepsA=boundary_surfaces_7, BrepsB=boundary_surfaces_6)  # -> flatten(Result)
boundary_surfaces_10 = BoundarySurfaces(Edges=voronoi_2)
boundary_surfaces_11 = BoundarySurfaces(Edges=offset_curve_9)
brep_edges_4 = BrepEdges(Brep=loft_3)  # -> Naked, Interior, NonManifold
brep_edges_5 = BrepEdges(Brep=loft_2)  # -> Naked, Interior, NonManifold
solid_difference_5 = SolidDifference(BrepsA=boundary_surfaces_10, BrepsB=boundary_surfaces_11)
brep_edges_6 = BrepEdges(Brep=solid_difference_4)  # -> Naked, Interior, NonManifold
brep_edges_7 = BrepEdges(Brep=solid_difference_3)  # -> Naked, Interior, NonManifold
unit_z_2 = UnitZ(Factor=1)
join_curves_5 = JoinCurves(Curves=brep_edges_5.Naked, Preserve=False)
join_curves_6 = JoinCurves(Curves=brep_edges_4.Naked, Preserve=False)
join_curves_7 = JoinCurves(Curves=brep_edges_6.Naked, Preserve=False)
join_curves_8 = JoinCurves(Curves=brep_edges_7.Naked, Preserve=False)
unit_z_3 = UnitZ(Factor=multiplication_9)
extrude = Extrude(Base=[list_item_16, list_item_17], Direction=unit_z_3)  # disabled
extrude_2 = Extrude(Base=[list_item_15, list_item_14], Direction=unit_z_3)  # disabled
extrude_3 = Extrude(Base=join_curves_7, Direction=unit_z_3)
extrude_4 = Extrude(Base=join_curves_8, Direction=unit_z_3)
extrude_5 = Extrude(Base=[join_curves_5, join_curves_6], Direction=unit_z_3)
cap_holes_ex = CapHolesEx(Brep=extrude_3)  # -> Brep, Caps, Solid
cap_holes_ex_2 = CapHolesEx(Brep=extrude_5)  # -> Brep, Caps, Solid
cap_holes_ex_3 = CapHolesEx(Brep=extrude_4)  # -> Brep, Caps, Solid
list_item_18 = ListItem(List=cap_holes_ex_3.Brep, Index=0, Wrap=True)
list_item_19 = ListItem(List=cap_holes_ex_3.Brep, Index=1, Wrap=True)
list_item_20 = ListItem(List=cap_holes_ex.Brep, Index=1, Wrap=True)
list_item_21 = ListItem(List=cap_holes_ex.Brep, Index=0, Wrap=True)
solid_difference_6 = SolidDifference(BrepsA=list_item_18, BrepsB=list_item_19)
solid_difference_7 = SolidDifference(BrepsA=list_item_21, BrepsB=list_item_20)
division = Division(A=multiplication_7, B=2)
negative = Negative(Value=division)
multiplication_11 = Multiplication(A=negative, B=pull_distance)
construct_domain = ConstructDomain(DomainStart=negative, DomainEnd=multiplication_11)
remap_numbers = RemapNumbers(Value=distance, Source=bounds, Target=construct_domain)  # -> Mapped, Clipped; disabled
unit_z_4 = UnitZ(Factor=remap_numbers.Mapped)  # disabled
extrude_6 = Extrude(Base=list_item_13, Direction=unit_z_4)  # disabled
remap_numbers_2 = RemapNumbers(Value=distance_2, Source=bounds_2, Target=construct_domain)  # -> Mapped, Clipped
unit_z_5 = UnitZ(Factor=remap_numbers_2.Mapped)
extrude_7 = Extrude(Base=solid_difference_5, Direction=unit_z_5)  # -> flatten(Extrusion)
group = Group(Objects=[cap_holes_ex_2.Brep, solid_difference_6, solid_difference_7])
unit_z_6 = UnitZ(Factor=division)
move_6 = Move(Geometry=extrude_2, Motion=unit_z_6)  # -> Geometry, Transform; disabled
move_7 = Move(Geometry=extrude, Motion=unit_z_6)  # -> Geometry, Transform; disabled
move_8 = Move(Geometry=group, Motion=unit_z_6)  # -> Geometry, Transform
group_2 = Group(Objects=[move_8.Geometry, extrude_7])
