# Grasshopper definition wk1 random tree practice.ghx (Grasshopper 1.0.7)

construct_domain = ConstructDomain(DomainStart=Slider(2, range=0..5), DomainEnd=Slider(4, range=0..5))
point = Point([<point referenced from the Rhino model> x27])
list_length = ListLength(List=point)
number_slider = Slider(0.79, range=-1.001..40)
graft_tree = GraftTree(Tree=point, IncludeEmptyLists=True, IncludeNullItems=True)
random = Random(Range=construct_domain, Number=list_length, Seed=2)
graft_tree_2 = GraftTree(Tree=random, IncludeEmptyLists=True, IncludeNullItems=True)
multiplication = Multiplication(A=graft_tree_2, B=Slider(0.15, range=0..1))
circle_cnr = CircleCNR(Center=graft_tree, Normal=Vector(0, 0, 1), Radius=graft_tree_2)
circle_cnr_2 = CircleCNR(Center=graft_tree, Normal=Vector(0, 0, 1), Radius=multiplication)
evaluate_curve = EvaluateCurve(Curve=reparameterize(circle_cnr), Parameter=[Slider(1, range=0..1), Slider(0.955, range=0..1)])  # -> Point, Tangent, Angle
line = Line(StartPoint=graft_tree, EndPoint=evaluate_curve.Point)
list_length_2 = ListLength(List=point)
trim_with_region = TrimWithRegion(Curve=line, Region=circle_cnr_2)  # -> Inside, Outside
curve = Curve(trim_with_region.Outside)
random_2 = Random(Range="360", Number=list_length_2, Seed=2)
panel = Panel(list_length_2)
shift_paths = ShiftPaths(Data=curve, Offset="-1")
graft_tree_3 = GraftTree(Tree=random_2, IncludeEmptyLists=True, IncludeNullItems=True)
panel_2 = Panel(random_2)
rotate = Rotate(Geometry=shift_paths, Angle=degrees(graft_tree_3), Plane=graft_tree)  # -> Geometry, Transform
