# Grasshopper definition wk2 STAIR DIY.ghx (Grasshopper 1.0.8)

number_slider = Slider(20, range=0..20)
construct_point = ConstructPoint(XCoordinate=Slider(0, range=0..100), YCoordinate=Slider(0, range=0..100), ZCoordinate=Slider(0, range=0..100))
series = Series(Start=Slider(0, range=0..100), Step=Slider(5, range=0..10), Count=number_slider)
unit_x = UnitX(Factor=series)
number_slider_2 = Slider(2, range=0..10)
move = Move(Geometry=construct_point, Motion=unit_x)  # -> Geometry, Transform
series_2 = Series(Start=Slider(0, range=0..100), Step=number_slider_2, Count=number_slider)
unit_y = UnitY(Factor=series_2)
move_2 = Move(Geometry=move.Geometry, Motion=unit_y)  # -> Geometry, Transform
panel = Panel(move_2.Geometry)
unit_y_2 = UnitY(NumberSlider=number_slider_2)
move_3 = Move(Geometry=move_2.Geometry, Motion=unit_y_2)  # -> Geometry, Transform
panel_2 = Panel(move_3.Geometry)
weave = Weave(Pattern=[0, 1], Stream0=move_2.Geometry, Stream1=move_3.Geometry, NullGaps=False)
panel_3 = Panel(weave)
polyline = PolyLine(Vertices=weave, Closed=False)
