# Grasshopper definition wk2 STAIR.ghx (Grasshopper 1.0.8)

construct_domain = ConstructDomain(DomainStart=Slider(0, range=0..10), DomainEnd=Slider(20, range=0..20))
range = Range(Domain=construct_domain, Steps=expr("x-1", "16"))
series = Series(Start="5", Step="5", Count="16")
list_item = ListItem(List=range, Index="0", Wrap=True)  # -> Item, Item1
shortest_list = ShortestList(ListListA=series, ListListB=range, TrimMode=2)  # -> ListListA, ListListB
subtraction = Subtraction(A=list_item.Item1, B=list_item.Item)
construct_point = ConstructPoint(XCoordinate=shortest_list.ListListA, YCoordinate=0, ZCoordinate=shortest_list.ListListB)
unit_z = UnitZ(Factor=subtraction)
panel = Panel(subtraction)
move = Move(Geometry=construct_point, Motion=unit_z)  # -> Geometry, Transform
panel_2 = Panel("""0
1""")
panel_3 = Panel(unit_z)
weave = Weave(Pattern=panel_2, Stream0=construct_point, Stream1=move.Geometry, NullGaps=False)
panel_4 = Panel("""-1
-2""")
point_list = PointList(Points=weave, Size=Slider(0.66, range=0..1))
cull_index = CullIndex(List=weave, Indices=panel_4, Wrap=True)
point_order = PointOrder(Points=weave)
panel_5 = Panel(weave)
polyline = PolyLine(Vertices=cull_index, Closed=False)
