# Grasshopper definition wk2 TRUSS.ghx (Grasshopper 1.0.8)
# plug-ins: RhinoCodePluginGH

number_slider = Slider(10, range=0..10)
curve = Curve(<curve referenced from the Rhino model>)
curve_2 = Curve(<curve referenced from the Rhino model>)
ironpython_2_script = IronPython2Script(top=curve, bottom=curve_2)  # -> out, trussWebs; inputs top: Curve, bottom: Curve
# ---------- ironpython_2_script: IronPython ----------
import ghpythonlib.components as ghc
# Point A
trussDivision = 10


# Point B
topPoints = ghc.DivideCurve(top, trussDivision, False)
bottomPoints = ghc.DivideCurve(bottom, trussDivision, False)

# Point C
topPoints = ghc.Dispatch(topPoints["points"],[False, True])
bottomPoints = ghc.Dispatch(bottomPoints["points"],[False, True])
print(topPoints)

# Point D
trussPoints = ghc.Weave([1,0],topPoints["list_a"],bottomPoints["list_b"])
print(trussPoints)

trussWebs = ghc.PolyLine(trussPoints,False)
# ---------- end ironpython_2_script ----------
divide_curve = DivideCurve(Curve=curve_2, Count=number_slider, Kinks=False)  # -> Points, Tangents, Parameters
panel = Panel("""0
1""")
divide_curve_2 = DivideCurve(Curve=curve, Count=number_slider, Kinks=False)  # -> Points, Tangents, Parameters
dispatch = Dispatch(List=divide_curve.Points, DispatchPattern=panel)  # -> ListA, ListB
dispatch_2 = Dispatch(List=divide_curve_2.Points, DispatchPattern=panel)  # -> ListA, ListB
point = Point(dispatch.ListB)
point_2 = Point(dispatch_2.ListA)
line = Line(StartPoint=divide_curve_2.Points, EndPoint=divide_curve.Points)
weave = Weave(Pattern=panel, Stream0=point, Stream1=point_2, NullGaps=False)
polyline = PolyLine(Vertices=weave, Closed=False)
