# Grasshopper definition wk3 STAIR DIY.ghx (Grasshopper 1.0.8)

number_slider = Slider(2.08, range=0..5)
number_slider_2 = Slider(20, range=0..100)
construct_point = ConstructPoint(XCoordinate=0, YCoordinate="0", ZCoordinate=0)
series = Series(Start=0, Step=Slider(3.37, range=0..10), Count=number_slider_2)
unit_x = UnitX(Factor=series)
move = Move(Geometry=construct_point, Motion=unit_x)  # -> Geometry, Transform
series_2 = Series(Start=0, Step=number_slider, Count=number_slider_2)
unit_z = UnitZ(Factor=series_2)
move_2 = Move(Geometry=move.Geometry, Motion=unit_z)  # -> Geometry, Transform
polyline = PolyLine(Vertices=move_2.Geometry, Closed=False)
polyline_2 = PolyLine(Vertices=move.Geometry, Closed=False)
unit_z_2 = UnitZ(Factor=Slider(4, range=0..10))
unit_z_3 = UnitZ(Factor=number_slider)
data = Data(unit_z_3)
multiplication = Multiplication(A=data, B=Slider(0.26, range=0..1))
move_3 = Move(Geometry=polyline, Motion=multiplication)  # -> Geometry, Transform
reverse = Reverse(Vector=unit_z_2)
move_4 = Move(Geometry=move_2.Geometry, Motion=unit_z_3)  # -> Geometry, Transform
loft = Loft(
    Curves=[polyline_2, move_3.Geometry],
    Options={Adjust=False, Closed=False, LoftEnds=0, LoftSimp=0, LoftType=0, Rebuild=10, Refit=0.01})
move_5 = Move(Geometry=polyline, Motion=reverse)  # -> Geometry, Transform
weave = Weave(Pattern=[0, 1], Stream0=move_2.Geometry, Stream1=move_4.Geometry, NullGaps=False)
surface_split = SurfaceSplit(Surface=loft, Curves=move_5.Geometry)
cull_index = CullIndex(List=weave, Indices="39", Wrap=True)

multiplication_2 = Multiplication(A=number_slider_2, B="2")
subtraction = Subtraction(A=multiplication_2, B="2")
list_item = ListItem(List=cull_index, Index=subtraction, Wrap=True)

list_item_2 = ListItem(List=surface_split, Index="1", Wrap=True)
polyline_3 = PolyLine(Vertices=cull_index, Closed=False)
surface_split_2 = SurfaceSplit(Surface=list_item_2, Curves=polyline_3)
explode = Explode(Curve=polyline_3, Recursive=True)  # -> reparameterize(Segments), Vertices
area = Area(Geometry=surface_split_2)  # -> Area, Centroid
evaluate_curve = EvaluateCurve(Curve=explode.Segments, Parameter=Slider(0.5, range=0..1))  # -> Point, Tangent, Angle
explode_2 = Explode(Curve=polyline_3, Recursive=True)  # -> Segments, Vertices
panel = Panel(area.Area)
dispatch = Dispatch(List=evaluate_curve.Point, DispatchPattern=[True, False])  # -> ListA, ListB
dispatch_2 = Dispatch(List=explode_2.Segments, DispatchPattern=[True, False])  # -> ListA, ListB
radial = Radial(Plane=dispatch.ListB, Size=Slider(0.71, range=0..2), ExtentR="1", ExtentP=Slider(4, range=0..20))  # -> Cells, Points
move_6 = Move(Geometry=radial.Cells, Motion=multiplication)  # -> Geometry, Transform
area_2 = Area(Geometry=move_6.Geometry)  # -> Area, Centroid
extrude = Extrude(Base=dispatch_2.ListB, Direction=multiplication)
list_item_3 = ListItem(List=surface_split_2, Index="0", Wrap=True)
unit_y = UnitY(Factor=Slider(1, range=0..1))
data_2 = Data(unit_y)
radial_2 = Radial(Plane=area_2.Centroid, Size=Slider(0.13, range=0..1), ExtentR="1", ExtentP=20)  # -> Cells, Points
extrude_2 = Extrude(Base=list_item_3, Direction=unit_y)
multiplication_3 = Multiplication(A=unit_y, B=Slider(20, range=0..50))
data_3 = Data(multiplication_3)
addition = Addition(A=data_3, B=data_2)
extrude_3 = Extrude(Base=extrude, Direction=addition)
move_7 = Move(Geometry=radial_2.Cells, Motion=multiplication_3)  # -> Geometry, Transform
move_8 = Move(Geometry=extrude_2, Motion=multiplication_3)  # -> Geometry, Transform
unit_y_2 = UnitY(Factor=Slider(1.1, range=1..1.1))
area_3 = Area(Geometry=extrude_3)  # -> Area, Centroid
merge = Merge(Data1=radial_2.Cells, Data2=move_7.Geometry)
division = Division(A=unit_y, B="2")
scale_nu = ScaleNU(Geometry=extrude_3, Plane=area_3.Centroid, ScaleX=1, ScaleY=unit_y_2, ScaleZ=1)  # -> Geometry, Transform
move_9 = Move(Geometry=merge, Motion=division)  # -> Geometry, Transform
unit_z_4 = UnitZ(Factor=Slider(10, range=0..10))
explode_object = ExplodeObject(Object=scale_nu.Geometry, Recursive=False)
extrude_4 = Extrude(Base=move_9.Geometry, Direction=unit_z_4)
list_item_4 = ListItem(List=explode_object, Index="1", Wrap=True)
area_4 = Area(Geometry=list_item_4)  # -> Area, Centroid
populate_2d = Populate2D(Region=list_item_4, Count=Slider(1000, range=0..1000), Seed=1)
voronoi = Voronoi(Points=populate_2d, Boundary=list_item_4, BruteForceOverride=False)
pull_point = PullPoint(Point=area_4.Centroid, ClosestOnly=True)  # -> ClosestPoint, Distance
unit_z_5 = UnitZ(Factor=Slider(0.17, range=0..0.5))
extrude_5 = Extrude(Base=voronoi, Direction=unit_z_5)
cap_holes = CapHoles(Brep=extrude_5)
