# Grasshopper definition wk3 STAIR.ghx (Grasshopper 1.0.8)

number_slider = Slider(20, range=0..20)
construct_domain = ConstructDomain(DomainStart=Slider(0, range=0..10), DomainEnd=number_slider)
range = Range(Domain=construct_domain, Steps=expr("x-1", "16"))
series = Series(Start="5", Step="5", Count="16")
list_item = ListItem(List=range, Index="0", Wrap=True)  # -> Item, Item1
shortest_list = ShortestList(ListListA=series, ListListB=range, TrimMode=2)  # -> ListListA, ListListB
subtraction = Subtraction(A=list_item.Item1, B=list_item.Item)
unit_y = UnitY(Factor=subtraction)
construct_point = ConstructPoint(XCoordinate=shortest_list.ListListA, YCoordinate=shortest_list.ListListB, ZCoordinate=0)
panel = Panel(subtraction)
move = Move(Geometry=construct_point, Motion=unit_y)  # -> Geometry, Transform
panel_2 = Panel("""0
1""")
panel_3 = Panel(unit_y)
weave = Weave(Pattern=panel_2, Stream0=construct_point, Stream1=move.Geometry, NullGaps=False)
panel_4 = Panel("""-1
-2""")
point_list = PointList(Points=weave, Size=Slider(0.66, range=0..1))
cull_index = CullIndex(List=weave, Indices=panel_4, Wrap=True)
point_order = PointOrder(Points=weave)
panel_5 = Panel(weave)
polyline = PolyLine(Vertices=cull_index, Closed=False)
bounding_box = BoundingBox(Content=cull_index, Plane=PlaneXY(0, 0, 0), UnionBox=True)  # -> Box, Box_2
deconstruct_box = DeconstructBox(Box=bounding_box.Box)  # -> Plane, X, Y, Z
plane_surface = PlaneSurface(Plane=deconstruct_box.Plane, XSize=deconstruct_box.X, YSize=deconstruct_box.Y)
unit_z = UnitZ(Factor=number_slider)
curve = Curve(<curve referenced from the Rhino model>)
curve_2 = Curve(<curve referenced from the Rhino model>)
surface_closest_point = SurfaceClosestPoint(Point=cull_index, Surface=reparameterize(plane_surface))  # -> Point, UVPoint, Distance
extrude = Extrude(Base=curve, Direction=unit_z)
extrude_2 = Extrude(Base=curve_2, Direction=unit_z)
evaluate_surface = EvaluateSurface(Surface=reparameterize(extrude), Point=surface_closest_point.UVPoint)  # -> Point, Normal, UDirection, VDirection, Frame
panel_6 = Panel(surface_closest_point.UVPoint)
evaluate_surface_2 = EvaluateSurface(Surface=reparameterize(extrude_2), Point=surface_closest_point.UVPoint)  # -> Point, Normal, UDirection, VDirection, Frame
polyline_2 = PolyLine(Vertices=evaluate_surface.Point, Closed=False)
polyline_3 = PolyLine(Vertices=evaluate_surface_2.Point, Closed=False)
pull_curve = PullCurve(Curve=polyline_2, Surface=extrude)
pull_curve_2 = PullCurve(Curve=polyline_3, Surface=extrude_2)
loft = Loft(
    Curves=[pull_curve_2, pull_curve],
    Options={Adjust=False, Closed=False, LoftEnds=0, LoftSimp=0, LoftType=0, Rebuild=10, Refit=0.01})
