# Grasshopper definition wk3 spl STAIR.ghx (Grasshopper 1.0.8)

number_slider = Slider(1, range=0..10)  # disabled
panel = Panel("360")  # disabled
number_slider_2 = Slider(0, range=0..360)  # disabled
number_slider_3 = Slider(20, range=0..100)  # disabled
number_slider_4 = Slider(10, range=0..10)  # disabled
multiplication = Multiplication(A=number_slider, B=panel)  # disabled
number_slider_5 = Slider(86225, range=0..100000)
number_slider_6 = Slider(5, range=0..10)  # disabled
number_slider_7 = Slider(5, range=0..10)  # disabled
construct_domain = ConstructDomain(DomainStart=number_slider_2, DomainEnd=multiplication)  # disabled
division = Division(A=multiplication, B=number_slider_3)  # disabled
construct_point = ConstructPoint(XCoordinate=number_slider_4, YCoordinate=0, ZCoordinate=0)  # disabled
construct_domain_2 = ConstructDomain(DomainStart=Slider(0, range=0..360), DomainEnd=number_slider_5)
division_2 = Division(A=number_slider_5, B=Slider(7, range=0..100))
xy_plane = XYPlane(Origin=Point(0, 0, 0))  # disabled
construct_point_2 = ConstructPoint(XCoordinate=Slider(8, range=0..100), YCoordinate=0, ZCoordinate=0)
construct_point_3 = ConstructPoint(XCoordinate=number_slider_6, YCoordinate=0, ZCoordinate=0)  # disabled
unit_x = UnitX(Factor=1)  # disabled
range = Range(Domain=construct_domain, Steps=division)  # disabled
unit_z = UnitZ(Factor=1)  # disabled
construct_point_4 = ConstructPoint(XCoordinate=0, YCoordinate=0, ZCoordinate=0)  # disabled
xy_plane_2 = XYPlane(Origin=Point(0, 0, 0))
range_2 = Range(Domain=construct_domain_2, Steps=division_2)
rotate = Rotate(Geometry=construct_point, Angle=degrees(range), Plane=xy_plane)  # -> Geometry, Transform; disabled
number_slider_8 = Slider(10, range=0..10)  # disabled
line_sdl = LineSDL(Start=construct_point_3, Direction=unit_x, Length=number_slider_7)  # disabled
unit_z_2 = UnitZ(Factor=range)  # disabled
line_sdl_2 = LineSDL(Start=construct_point_4, Direction=unit_z, Length=1)  # disabled
number_slider_9 = Slider(360, range=0..360)  # disabled
number_slider_10 = Slider(93.02, range=0..360)  # disabled
panel_2 = Panel(range_2)
repeat_data = RepeatData(Data="300", Length="10")
division_3 = Division(A=unit_z_2, B=number_slider_8)  # disabled
move = Move(Geometry=rotate.Geometry, Motion=division_3)  # -> Geometry, Transform; disabled
rotate_2 = Rotate(Geometry=construct_point_2, Angle=degrees(range_2), Plane=xy_plane_2)  # -> Geometry, Transform
merge = Merge(Data1=flatten(repeat_data), Data2=flatten("1000"))
radians = Radians(Degrees=number_slider_10)  # disabled
radians_2 = Radians(Degrees=number_slider_9)  # disabled
interpolate = Interpolate(Vertices=move.Geometry, Degree=3, Periodic=False, KnotStyle=1)  # -> Curve, Length, Domain; disabled
mass_addition = MassAddition(Input=merge)  # -> Result, PartialResults
construct_domain_3 = ConstructDomain(DomainStart=radians, DomainEnd=radians_2)  # disabled
revolution = Revolution(Curve=line_sdl, Axis=line_sdl_2, Domain=construct_domain_3)  # disabled
interpolate_2 = Interpolate(Vertices=rotate_2.Geometry, Degree=3, Periodic=False, KnotStyle=1)  # -> Curve, Length, Domain
length = Length(Curve=interpolate_2.Curve)
panel_3 = Panel(length)
multiplication_2 = Multiplication(A=length, B=Slider(98, range=0..1000))
division_4 = Division(A=mass_addition.PartialResults, B=multiplication_2)
shatter = Shatter(Curve=reparameterize(interpolate_2.Curve), Parameters=division_4)
panel_4 = Panel(division_4)
cull_index = CullIndex(List=shatter, Indices="-1", Wrap=True)
number_slider_11 = Slider(11, range=0..20)
scale = Scale(Geometry=cull_index, Center=Point(0, 0, 0), Factor=Slider(7, range=0..10))  # -> Geometry, Transform
ruled_surface = RuledSurface(CurveA=cull_index, CurveB=scale.Geometry)
list_length = ListLength(List=ruled_surface)
series = Series(Start=number_slider_11, Step=number_slider_11, Count=list_length)
unit_z_3 = UnitZ(Factor=series)
move_2 = Move(Geometry=[ruled_surface, cull_index], Motion=unit_z_3)  # -> Geometry, Transform
curve = Curve(move_2.Geometry)
