# Grasshopper definition wk5 triangle.ghx (Grasshopper 1.0.8)

number_slider = Slider(10, range=0..10)  # disabled
number_slider_2 = Slider(10, range=0..10)  # disabled
number_slider_3 = Slider(0.109, range=0..1)  # disabled
number_slider_4 = Slider(15, range=0..30)
triangular = Triangular(Plane=PlaneXY(0, 0, 0), Size=1, ExtentX=number_slider, ExtentY=number_slider)  # -> Cells, Points; disabled
number_slider_5 = Slider(0.109, range=0..1)  # disabled
triangular_2 = Triangular(Plane=PlaneXY(0, 0, 0), Size=1, ExtentX=number_slider_2, ExtentY=number_slider_2)  # -> Cells, Points; disabled
triangular_3 = Triangular(Plane=PlaneXY(0, 0, 0), Size=1, ExtentX=number_slider_4, ExtentY=number_slider_4)  # -> Cells, Points
point = Point(<point referenced from the Rhino model>)  # disabled
flatten_tree = FlattenTree(Tree=triangular.Cells, Path="{0}")  # disabled
number_slider_6 = Slider(0.999, range=0..0.999)  # disabled
number_slider_7 = Slider(0, range=0..100)  # disabled
point_2 = Point([<point referenced from the Rhino model> x2])  # disabled
flatten_tree_2 = FlattenTree(Tree=triangular_2.Cells, Path="{0}")  # disabled
flatten_tree_3 = FlattenTree(Tree=triangular_3.Cells, Path="{0}")
number_slider_8 = Slider(0.999, range=0..0.999)  # disabled
number_slider_9 = Slider(0, range=0..100)  # disabled
point_3 = Point([<point referenced from the Rhino model> x5])
area = Area(Geometry=flatten_tree)  # -> graft(Centroid); disabled
distance = Distance(PointA=area, PointB=point)  # disabled
flatten_tree_4 = FlattenTree(Tree=distance, Path="{0}")  # disabled
data = Data(distance)  # disabled
explode = Explode(Curve=flatten_tree, Recursive=True)  # -> Segments, Vertices; disabled
construct_domain = ConstructDomain(DomainStart=number_slider_7, DomainEnd=number_slider_6)  # disabled
bounds = Bounds(Numbers=flatten_tree_4)  # disabled
panel = Panel(explode.Vertices)  # disabled
area_2 = Area(Geometry=flatten_tree_2)  # -> graft(Centroid); disabled
distance_2 = Distance(PointA=area_2, PointB=point_2)  # disabled
mass_addition = MassAddition(Input=distance_2)  # -> Result, PartialResults; disabled
data_2 = Data(mass_addition.Result)  # disabled
explode_2 = Explode(Curve=flatten_tree_2, Recursive=True)  # -> Segments, Vertices; disabled
construct_domain_2 = ConstructDomain(DomainStart=number_slider_9, DomainEnd=number_slider_8)  # disabled
area_3 = Area(Geometry=flatten_tree_3)  # -> graft(Centroid)
distance_3 = Distance(PointA=area_3, PointB=point_3)
flatten_tree_5 = FlattenTree(Tree=mass_addition.Result, Path="{0}")  # disabled
explode_3 = Explode(Curve=flatten_tree_3, Recursive=True)  # -> Segments, Vertices
panel_2 = Panel(explode_3.Vertices)
construct_domain_3 = ConstructDomain(DomainStart=Slider(0, range=0..100), DomainEnd=Slider(4.011, range=0..10))
construct_domain_4 = ConstructDomain(DomainStart=Slider(1, range=0..1), DomainEnd=Slider(0, range=0..0.999))
bounds_2 = Bounds(Numbers=flatten_tree_5)  # disabled
panel_3 = Panel(explode_2.Vertices)  # disabled
evaluate_length = EvaluateLength(Curve=reparameterize(explode.Segments), Length=0.5, Normalized=True)  # -> Point, Tangent, Parameter; disabled
remap_numbers = RemapNumbers(Value=data, Source=bounds, Target=construct_domain)  # -> Mapped, Clipped; disabled
panel_4 = Panel(bounds)  # disabled
panel_5 = Panel(area)  # disabled
flatten_tree_6 = FlattenTree(Tree=distance_3, Path="{0}")
evaluate_length_2 = EvaluateLength(Curve=reparameterize(explode_2.Segments), Length=0.5, Normalized=True)  # -> Point, Tangent, Parameter; disabled
remap_numbers_2 = RemapNumbers(Value=data_2, Source=bounds_2, Target=construct_domain_2)  # -> Mapped, Clipped; disabled
evaluate_length_3 = EvaluateLength(Curve=reparameterize(explode_3.Segments), Length=0.5, Normalized=True)  # -> Point, Tangent, Parameter
panel_6 = Panel(bounds_2)  # disabled
panel_7 = Panel(area_2)  # disabled
panel_8 = Panel(area_3)
bounds_3 = Bounds(Numbers=flatten_tree_6)
remap_numbers_3 = RemapNumbers(Value=distance_3, Source=construct_domain_3, Target=construct_domain_4)  # -> Mapped, Clipped
line = Line(StartPoint=evaluate_length.Point, EndPoint=area)  # disabled
data_3 = Data(distance_3)
construct_domain_5 = ConstructDomain(DomainStart=Slider(0.136, range=0..1), DomainEnd=Slider(0.941, range=0..1))
panel_9 = Panel(evaluate_length.Point)  # disabled
point_4 = Point(explode.Vertices)  # disabled
panel_10 = Panel(remap_numbers_2.Mapped)  # disabled
line_2 = Line(StartPoint=evaluate_length_2.Point, EndPoint=area_2)  # disabled
boolean = Boolean(remap_numbers_3.Clipped)
line_3 = Line(StartPoint=evaluate_length_3.Point, EndPoint=area_3)
dispatch = Dispatch(List=remap_numbers_3.Clipped, DispatchPattern=boolean)  # -> ListA, ListB
panel_11 = Panel(evaluate_length_2.Point)  # disabled
panel_12 = Panel(point_4)  # disabled
point_5 = Point(explode_2.Vertices)  # disabled
evaluate_length_4 = EvaluateLength(Curve=reparameterize(line), Length=remap_numbers.Mapped, Normalized=True)  # -> Point, Tangent, Parameter; disabled
panel_13 = Panel(evaluate_length_3.Point)
remap_numbers_4 = RemapNumbers(Value=data_3, Source=bounds_3, Target=construct_domain_5)  # -> Mapped, Clipped
sort_list = SortList(Keys=dispatch.ListA)  # -> reverse(Keys), ValuesA
panel_14 = Panel(point_5)  # disabled
evaluate_length_5 = EvaluateLength(Curve=reparameterize(line_2), Length=remap_numbers_2.Mapped, Normalized=True)  # -> Point, Tangent, Parameter; disabled
list_item = ListItem(List=sort_list.Keys, Index=0, Wrap=True)
weave = Weave(Pattern=[0, 1], Stream0=point_4, Stream1=evaluate_length_4.Point, NullGaps=False)  # disabled
unit_z = UnitZ(Factor=number_slider_3)  # disabled
panel_15 = Panel(evaluate_length_4.Point)  # disabled
panel_16 = Panel(weave)  # disabled
construct_domain_6 = ConstructDomain(DomainStart=Slider(0, range=0..1), DomainEnd=Slider(0.999, range=0..1))
weave_2 = Weave(Pattern=[0, 1], Stream0=point_5, Stream1=evaluate_length_5.Point, NullGaps=False)  # disabled
point_6 = Point(explode_3.Vertices)
unit_z_2 = UnitZ(Factor=number_slider_5)  # disabled
panel_17 = Panel(evaluate_length_5.Point)  # disabled
panel_18 = Panel(weave_2)  # disabled
polyline = PolyLine(Vertices=weave, Closed=False)  # disabled
replace_nulls = ReplaceNulls(Items=list_item, Replacements="0")  # -> Items, Count
panel_19 = Panel(point_6)
move = Move(Geometry=area, Motion=unit_z)  # -> Geometry, Transform; disabled
extrude_point = ExtrudePoint(Base=polyline, Point=move.Geometry)  # disabled
unit_z_3 = UnitZ(Factor=Slider(0.109, range=0..1))
remap_numbers_5 = RemapNumbers(Value=replace_nulls.Items, Source=Domain(0, 1), Target=construct_domain_6)  # -> Mapped, Clipped
polyline_2 = PolyLine(Vertices=weave_2, Closed=False)  # disabled
move_2 = Move(Geometry=area_2, Motion=unit_z_2)  # -> Geometry, Transform; disabled
panel_20 = Panel(list_item)
extrude_point_2 = ExtrudePoint(Base=polyline_2, Point=move_2.Geometry)  # disabled
list_item_2 = ListItem(List=remap_numbers_5.Mapped, Index=0, Wrap=True)
move_3 = Move(Geometry=area_3, Motion=unit_z_3)  # -> Geometry, Transform
graph_mapper = GraphMapper(list_item_2, x0=0, x1=1, y0=0, y1=1, container_name="Bezier", cpx=[0, 0.401784867, 0.5999020338, 1], cpy=[0, 0, 1, 1])
evaluate_length_6 = EvaluateLength(Curve=reparameterize(line_3), Length=graph_mapper, Normalized=True)  # -> Point, Tangent, Parameter
weave_3 = Weave(Pattern=[0, 1], Stream0=point_6, Stream1=evaluate_length_6.Point, NullGaps=False)
panel_21 = Panel(evaluate_length_6.Point)
panel_22 = Panel(weave_3)
polyline_3 = PolyLine(Vertices=weave_3, Closed=False)
extrude_point_3 = ExtrudePoint(Base=polyline_3, Point=move_3.Geometry)
